# Grasshopper definition um_HOPSTEST_REDUCED.gh (Grasshopper 1.0.7)

maxdist = GetNumber(
    Slider(12, range=0..100),
    AtLeast=0,
    AtMost=1,
    Maximum=1.797693135e+308,
    Minimum=0.2,
    Prompt="search radius when connecting different mobiltiy modes")
activitynode_snapdist = GetNumber(
    Slider(12, range=0..100),
    AtLeast=0,
    AtMost=2147483647,
    Maximum=1.797693135e+308,
    Minimum=0.1,
    Prompt="search radius when connecting activity nodes")
snapdist = GetNumber(
    Slider(13, range=0..100),
    AtLeast=0,
    AtMost=1,
    Maximum=1.797693135e+308,
    Minimum=0.1,
    Prompt="radius to snap to existing sub-division points c")

highstreet = Slider(42, range=10..100)
mobilitycorridorinterval = Slider(130, range=50..250)
moduleheight = Slider(500, range=0..1000)
module_lenght = Slider(800, range=0..1000)
highstreet_2 = Slider(40, range=0..100)
mobilitycorridoroffset = Slider(10, range=0..100)

yshift = Slider(15, range=0..50)
# Model Attributes and default values
horizontalmovementkeys = Panel("""MM_lanes
MM_shared
pedestrian
DRT_demand
DRT_schedule
elevatorCoreExpress
elevatorCoreLocal
escalator
activityNode
GMT
HSR""")
mode_attributes = Panel("""mode
avg. speed
avg. waiting time
capacity
one-way
line offset
auto intersect
connectionTarget
exitTime""")
unit_y = UnitY(Factor=Slider(170, range=0..1000))

# ---- group: default programs
small_paths = Panel("""false
false
true
false
false
false
false
false
false
false
false""")
local_high_street = Panel("""false
true
true
false
false
false
false
false
false
false
false""")
high_street_mobility_corridor = Panel("""true
false
true
true
true
false
false
false
false
false
false""")
elevatorcoreexpress = Panel("""false
false
false
false
false
true
false
false
false
false
false""")
elevatorcorelocal = Panel("""false
false
false
false
false
false
true
false
false
false
false""")
escalator = Panel("""false
false
false
false
false
false
false
true
false
false
false""")
building = Panel("""false
false
false
false
false
false
false
false
true
false
false""")
gmt = Panel("""false
false
false
false
false
false
false
false
false
true
false""")
hsr = Panel("""false
false
false
false
false
false
false
false
false
false
true""")
entwine = Entwine(
    Branch00=small_paths,
    Branch01=local_high_street,
    Branch02=high_street_mobility_corridor,
    Branch03=elevatorcoreexpress,
    Branch04=elevatorcorelocal,
    Branch05=building,
    Branch06=gmt,
    Branch07=hsr,
    FlattenInputs=True)  # -> simplify(Result)

# ----
num_elevator_interval_local_1st_public_s = Number(Slider(0.5, range=0..10))  # "Num_elevator interval_local_1st public street"
num_elevator_interval_local_2nd_public_s = Number(Slider(1.5, range=0..10))  # "Num_elevator interval_local_2nd public street"
num_elevator_interval_express_1st_interv = Number(Slider(4, range=0..10))  # "Num_elevator interval_express_1st interval"
num_num_of_modules_in_activity_center = Number(Slider(5, range=0..100))
num_number_of_floors_in_podium = Number(Slider(2, range=0..10))
num_dist_between_gmt_hrs = Number(Slider(8, range=0..1000))
num_number_of_modules_row = Number(Slider(8, range=0..10))
num_elevator_interval_express = Number(Slider(30, range=0..100))
num_elevator_dist_from_edge = Number(Slider(10, range=0..100))
num_elevator_interval_local = Number(Slider(10, range=0..100))
num_module_width = Number(Slider(100, range=0..1000))
num_elevator_width = Number(Slider(27.5, range=0..100))
num_podium_height = Number(Slider(10, range=0..100))
num_floor_number = Number(Slider(115, range=0..1000))
num_floor_height = Number(Slider(4.26, range=0..10))
attributevalues = Data(entwine)
attributekeys = Data(horizontalmovementkeys)

_220906_universal_module_basics = _220906_universalModuleBasics(
    num_module_width=num_module_width,
    num_number_of_modules_row=num_number_of_modules_row,
    num_floor_height=num_floor_height,
    num_floor_number=num_floor_number,
    num_podium_height=num_podium_height,
    num_number_of_floors_in_podium=num_number_of_floors_in_podium,
    num_elevator_width=num_elevator_width,
    num_elevator_dist_from_edge=num_elevator_dist_from_edge,
    num_elevator_interval_express=num_elevator_interval_express,
    num_elevator_interval_local=num_elevator_interval_local,
    num_elevator_interval_express_1st_interv=num_elevator_interval_express_1st_interv,
    num_elevator_interval_local_2nd_public_s=num_elevator_interval_local_2nd_public_s,
    num_elevator_interval_local_1st_public_s=num_elevator_interval_local_1st_public_s,
    num_num_of_modules_in_activity_center=num_num_of_modules_in_activity_center,
    num_dist_between_gmt_hrs=num_dist_between_gmt_hrs,
    attributekeys=attributekeys,
    attributevalues=attributevalues)  # -> pt_elev_ctr_express_7, pt_elev_ctr_local_14, crv_elev_nodes_express_7, crv_elev_nodes_local_7, pt_elev_ctr_express_8, pt_elev_ctr_local_15, crv_bridges_5, crv_bridge_bottom_5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

panel = Panel("OUTPUTS")
crv_elev_nodes_express = Curve(_220906_universal_module_basics.crv_elev_nodes_express_7)
crv_elev_nodes_local = Curve(_220906_universal_module_basics.crv_elev_nodes_local_7)
pt_elev_ctr_express = Point(_220906_universal_module_basics.pt_elev_ctr_express_8)
pt_elev_ctr_express_2 = Point(_220906_universal_module_basics.pt_elev_ctr_express_7)
pt_elev_ctr_local = Point(_220906_universal_module_basics.pt_elev_ctr_local_14)
pt_elev_ctr_local_2 = Point(_220906_universal_module_basics.pt_elev_ctr_local_15)
crv_bridge_bottom = Curve(_220906_universal_module_basics.crv_bridge_bottom_5)
pt_gmt_station = Point(_220906_universal_module_basics.pt_gmt_station_6)
pt_hrs_station = Point(_220906_universal_module_basics.pt_hrs_station_5)
crv_gmt_line = Curve(_220906_universal_module_basics.crv_gmt_line_5)
crv_hrs_line = Curve(_220906_universal_module_basics.crv_hrs_line_5)
crv_bridges = Curve(_220906_universal_module_basics.crv_bridges_5)

pt_elev_ctr_express_3 = Point(simplify(pt_elev_ctr_express_2))
pt_elev_ctr_local_3 = Point(simplify(pt_elev_ctr_local))

tree_statistics = TreeStatistics(Tree=pt_elev_ctr_express_3)  # -> Paths, Length, Count
list_item = ListItem(List=tree_statistics.Paths, Index=Slider(0, range=0..100), Wrap=True)
tree_branch = TreeBranch(Tree=pt_elev_ctr_express_3, Path=list_item, MaintainPaths=False)
deconstruct = Deconstruct(Point=tree_branch)  # -> XComponent, YComponent, ZComponent

tree_statistics_2 = TreeStatistics(Tree=pt_elev_ctr_local_3)  # -> Paths, Length, Count
list_item_2 = ListItem(List=tree_statistics_2.Paths, Index=Slider(0, range=0..100), Wrap=True)
tree_branch_2 = TreeBranch(Tree=pt_elev_ctr_local_3, Path=list_item_2, MaintainPaths=False)
deconstruct_2 = Deconstruct(Point=tree_branch_2)  # -> XComponent, YComponent, ZComponent

gmt_2 = Panel("""GMT
12
180
36000
true
1
[]
["pedestrian"]
30""")
mb_lanes = ColourSwatch(SwatchColor=RGB(51, 255, 75))
mb_shared = ColourSwatch(SwatchColor=RGB(156, 255, 184))
pedestrian = ColourSwatch(SwatchColor=RGB(137, 176, 77))
drt_demand = ColourSwatch(SwatchColor=RGB(166, 218, 255))
drt_schedule = ColourSwatch(SwatchColor=RGB(57, 160, 219))
elevatorcoreexpress_2 = ColourSwatch(SwatchColor=RGB(0, 102, 161))
elevatorcorelocal_2 = ColourSwatch(SwatchColor=RGB(72, 194, 194))
escalator_2 = ColourSwatch(SwatchColor=RGB(180, 209, 207))
building_2 = ColourSwatch(SwatchColor=RGB(255, 255, 255))
gmt_3 = ColourSwatch(SwatchColor=RGB(255, 157, 0))
hrs = ColourSwatch(SwatchColor=RGB(255, 61, 61))
hsr_2 = Panel("""HSR
145
300
60000
true
1
[]
["pedestrian"]
60""")

elevatorcoreexpress_3 = Panel("""elevatorCoreExpress
10
34
26
false
-0.1
[]
["pedestrian"]
10""")
mm_lanes = Panel("""MM_lanes
5.5
120
100
false
1
["MM_lanes"]
[]
30""")
elevatorcorelocal_3 = Panel("""elevatorCoreLocal
2.7
34
23
false
0.1
[]
["pedestrian"]
10""")
mm_shared = Panel("""MM_shared
2
120
100
false
1.2
["MM_shared"]
[]
30""")
escalator_3 = Panel("""escalator
0.75
0.2
100
false
0.2
["escalator"]
["pedestrian"]
2""")
pedestrian_2 = Panel("""pedestrian
1.2
0
200
false
0
["pedestrian"]
["MM_shared","MM_lanes"]
0""")
drt_demand_2 = Panel("""DRT_demand
8
120
1800
false
-4
["DRT_demand"]
["pedestrian"]
30""")
activitynode = Panel("""building
1.4
25
100
false
0.5
[]
["pedestrian"]
25""")
drt_schedule_2 = Panel("""DRT_schedule
10
60
180
false
-5.25
["DRT_schedule"]
["pedestrian"]
30""")
merge = Merge(
    Data1=graft(mm_lanes),
    Data2=graft(mm_shared),
    Data3=graft(pedestrian_2),
    Data4=graft(drt_demand_2),
    Data5=graft(drt_schedule_2),
    Data6=graft(elevatorcoreexpress_3),
    Data7=graft(elevatorcorelocal_3),
    Data8=graft(escalator_3),
    Data9=graft(activitynode),
    Data10=graft(gmt_2),
    Data11=graft(hsr_2))  # -> simplify(Result)
flip_matrix = FlipMatrix(Data=merge)

merge_2 = Merge(
    Data1=mb_lanes,
    Data2=mb_shared,
    Data3=pedestrian,
    Data4=drt_demand,
    Data5=drt_schedule,
    Data6=elevatorcoreexpress_2,
    Data7=elevatorcorelocal_2,
    Data8=escalator_2,
    Data9=building_2,
    Data10=gmt_3,
    Data11=hrs)
cluster = Cluster_5(list_2=flip_matrix, list=flip_matrix)  # -> list_3, warning

highstreet_3 = Slider(342, range=10..400)
highstreet_4 = Slider(82, range=0..500)

attributes_per_mode = Panel(cluster.list_3)
panel_2 = Panel(cluster.warning)
crv_bridges_2 = Curve(crv_bridges)
crv_bridge_bottom_2 = Curve(crv_bridge_bottom)

programid = Panel("3")
crv_elev_nodes_express_2 = Curve(flatten(crv_elev_nodes_express))

programid_2 = Panel("1")
crv_bridges_all = Curve(flatten([crv_bridges_2, crv_bridge_bottom_2]))

programid_3 = Panel("7")
crv_hrs_line_2 = Curve(flatten(crv_hrs_line))

crv_elev_nodes_local_2 = Curve(flatten(crv_elev_nodes_local))
programid_4 = Panel("4")

programid_5 = Panel("6")
crv_gmt_line_2 = Curve(flatten(crv_gmt_line))

join_curves = JoinCurves(Curves=crv_elev_nodes_express_2, Preserve=False)
join_curves_2 = JoinCurves(Curves=crv_elev_nodes_local_2, Preserve=False)
join_curves_3 = JoinCurves(Curves=crv_bridges_all, Preserve=False)
join_curves_4 = JoinCurves(Curves=crv_hrs_line_2, Preserve=False)
join_curves_5 = JoinCurves(Curves=crv_gmt_line_2, Preserve=False)
list_length = ListLength(List=join_curves)
list_length_2 = ListLength(List=join_curves_2)
list_length_3 = ListLength(List=join_curves_3)
list_length_4 = ListLength(List=join_curves_4)
list_length_5 = ListLength(List=join_curves_5)
duplicate_data = DuplicateData(Data=programid, Number=list_length, Order=True)
duplicate_data_2 = DuplicateData(Data=programid_4, Number=list_length_2, Order=True)
duplicate_data_3 = DuplicateData(Data=programid_2, Number=list_length_3, Order=True)
duplicate_data_4 = DuplicateData(Data=programid_3, Number=list_length_4, Order=True)
duplicate_data_5 = DuplicateData(Data=programid_5, Number=list_length_5, Order=True)
baketolayer = Button()
cluster_2 = Cluster(attributekeys=horizontalmovementkeys, attributevalues=entwine, type=duplicate_data, geometry=join_curves)  # -> userkeys, uservalues, geometry_4, elefrontattr_2, bakename
cluster_3 = Cluster(attributekeys=horizontalmovementkeys, attributevalues=entwine, type=duplicate_data_2, geometry=join_curves_2)  # -> userkeys, uservalues, geometry_4, elefrontattr_2, bakename
cluster_4 = Cluster(attributekeys=horizontalmovementkeys, attributevalues=entwine, type=duplicate_data_3, geometry=crv_bridges_all)  # -> userkeys, uservalues, geometry_4, elefrontattr_2, bakename
cluster_5 = Cluster(attributekeys=horizontalmovementkeys, attributevalues=entwine, type=duplicate_data_4, geometry=crv_hrs_line_2)  # -> userkeys, uservalues, geometry_4, elefrontattr_2, bakename
# Spine: GMT & HRS
cluster_6 = Cluster(attributekeys=horizontalmovementkeys, attributevalues=entwine, type=duplicate_data_5, geometry=crv_gmt_line_2)  # -> userkeys, uservalues, geometry_4, elefrontattr_2, bakename
panel_3 = Panel("DRT")  # disabled
panel_4 = Panel("GMT")  # disabled
concatenate = Concatenate(FragmentA=cluster_4.bakename, FragmentB="bridge")
concatenate_2 = Concatenate(FragmentA=cluster_5.bakename, FragmentB=panel_3)  # disabled
concatenate_3 = Concatenate(FragmentA=cluster_6.bakename, FragmentB=panel_4)  # disabled

point = Point()  # disabled
# re-bake when new geometry
# was generated
point_2 = Point()  # disabled

# ----
# fetch geometry & their attributes
modecolors = Data(merge_2)
modeattribute_keys = Data(mode_attributes)
modeattributes = Data(simplify(attributes_per_mode))

pt_elev_ctr_express_4 = Point(pt_elev_ctr_express)
pt_elev_ctr_local_4 = Point(pt_elev_ctr_local_2)
pt_gmt_station_2 = Point(pt_gmt_station)
pt_hrs_station_2 = Point(pt_hrs_station)

# ---- group: activityNodes
angeo = Data(Tree({0}: [Point(750, 175, 52.6), Point(750, 175, 10)], {1}: [Point(750, 175, 95.2), Point(750, 175, 52.6)], {2}: [Point(750, 175, 137.8), Point(750, 175, 95.2)], {3}: [Point(750, 175, 180.4), Point(750, 175, 137.8)], {4}: [Point(750, 175, 223), Point(750, 175, 180.4)], {5}: [Point(750, 175, 265.6), Point(750, 175, 223)]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))
anattr = Data(Tree({0}: ["8231.884058", "0", "7200", "0", "15333.333333", "topPtActNode_{1;7}_11", "brepActNode_{1;7}_11"], {1}: ["8231.884058", "0", "7200", "0", "15333.333333", "bottomPtActNode_{1;7}_11", "brepActNode_{1;7}_11"], {2}: ["16463.768116", "9000", "7200", "4000", "0", "topPtActNode_{1;7}_10", "brepActNode_{1;7}_10"], {3}: ["16463.768116", "9000", "7200", "4000", "0", "bottomPtActNode_{1;7}_10", "brepActNode_{1;7}_10"], {4}: ["32927.536232", "0", "0", "2000", "5111.111111", "topPtActNode_{1;7}_9", "brepActNode_{1;7}_9"], {5}: ["32927.536232", "0", "0", "2000", "5111.111111", "bottomPtActNode_{1;7}_9", "brepActNode_{1;7}_9"]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))
data = Data([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])

# ----
pt_elev_ctr_local_5 = Point(flatten(pt_elev_ctr_express_4))
pt_elev_ctr_local_6 = Point(flatten(pt_elev_ctr_local_4))
pt_hrs_station_3 = Point(flatten(pt_hrs_station_2))
pt_gmt_station_3 = Point(flatten(pt_gmt_station_2))
geometry = Geometry([Point(103.7962097, 54.09079069, 0), Point(378.2735466, 196.264543, 0)])
cull_duplicates = CullDuplicates(Points=pt_gmt_station_3, Tolerance=0.1, CullMode=1)  # -> Points, Indices, Valence
cull_duplicates_2 = CullDuplicates(Points=pt_hrs_station_3, Tolerance=0.1, CullMode=1)  # -> Points, Indices, Valence
cull_duplicates_3 = CullDuplicates(Points=pt_elev_ctr_local_6, Tolerance=0.1, CullMode=1)  # -> Points, Indices, Valence
cull_duplicates_4 = CullDuplicates(Points=pt_elev_ctr_local_5, Tolerance=0.1, CullMode=1)  # -> Points, Indices, Valence
manualpts = Data(geometry)
manualpts_2 = Data(geometry)
accesspoints_activitynodes = Data(flatten(angeo))

manualpts_3 = Data(cull_duplicates.Points)
merge_nearby = Slider(7, range=0..100)

manualpts_4 = Data(cull_duplicates_2.Points)
merge_nearby_2 = Slider(7, range=0..100)

manualpts_5 = Data(manualpts_2)
merge_nearby_3 = Slider(28, range=0..100)

manualpts_6 = Data(cull_duplicates_4.Points)
merge_nearby_4 = Slider(18, range=0..100)

manualpts_7 = Data(cull_duplicates_3.Points)
merge_nearby_5 = Slider(7, range=0..100)

manualpts_8 = Data(manualpts)
merge_nearby_6 = Slider(18, range=0..100)

panel_5 = Panel("\"+\" is the seperator")
panel_6 = Panel("add extra point(s)")
relevant_segment_attributes = Panel("""mode
avg. speed
capacity
one-way""")

point_3 = Point()  # disabled
point_4 = Point()  # disabled

point_5 = Point()  # disabled
# Export
point_6 = Point()  # disabled

context_print = ContextPrint(Text="NEIN!")
context_print_2 = ContextPrint(Text="NEIN!")
context_print_3 = ContextPrint(Text="NEIN!")
context_print_4 = ContextPrint(Text="NEIN!")

# ---- group: mobility corridor
# Initial Geometry/Network Generation
panel_7 = Panel("2")
unit_x = UnitX(Factor=1)
construct_point = ConstructPoint(XCoordinate=0, YCoordinate=yshift, ZCoordinate=deconstruct.ZComponent)

interval = Data(mobilitycorridorinterval)
modulelength = Data(module_lenght)
program = Data(panel_7)
offset = Data(mobilitycorridoroffset)
moduleheight_2 = Data(moduleheight)

subtraction = Subtraction(A=moduleheight_2, B=offset)
division = Division(A=subtraction, B=interval)
number = Number(expr("round(x-0.4)", division))
series = Series(Start=offset, Step=interval, Count=expr("x+1", number))
line_sdl = LineSDL(Start=construct_point, Direction=unit_x, Length=modulelength)

# ----
lines = Data(line_sdl)
programattr = Data(program)
m = Data(unit_y)
move = Move(Geometry=lines, Motion=m)  # -> Geometry, Transform
merge_3 = Merge(Data1=lines, Data2=move.Geometry)  # -> flatten(Result)
list_length_6 = ListLength(List=merge_3)
duplicate_data_6 = DuplicateData(Data=programattr, Number=list_length_6, Order=True)
lines_2 = Data(merge_3)
type = Data(duplicate_data_6)

# ----
# bake geometry with attributes
cluster_7 = Cluster(attributekeys=horizontalmovementkeys, attributevalues=entwine, type=type, geometry=lines_2)  # -> userkeys, uservalues, geometry_4, elefrontattr_2, bakename

# ---- group: small paths
panel_8 = Panel("0")
unit_x_2 = UnitX(Factor=1)
treshold = Slider(10, range=1..60)

dominatinglines = Data(lines_2)
interval_2 = Data(highstreet_3)
program_2 = Data(panel_8)
modulelength_2 = Data(module_lenght)
offset_2 = Data(highstreet_4)
moduleheight_3 = Data(moduleheight)

division_2 = Division(A=moduleheight_3, B=interval_2)
number_2 = Number(expr("round(x-0.4)", division_2))
series_2 = Series(Start=offset_2, Step=interval_2, Count=number_2)
construct_point_2 = ConstructPoint(XCoordinate=0, YCoordinate=yshift, ZCoordinate=series_2)
line_sdl_2 = LineSDL(Start=construct_point_2, Direction=unit_x_2, Length=modulelength_2)
curve_proximity = CurveProximity(CurveA=graft(line_sdl_2), CurveB=dominatinglines)  # -> PointA, PointB, simplify(Distance)
larger_than = LargerThan(FirstNumber=curve_proximity.Distance, SecondNumber=treshold)  # -> LargerThan, OrEqualTo
list_length_7 = ListLength(List=dominatinglines)
mass_addition = MassAddition(Input=larger_than.OrEqualTo)  # -> Result, PartialResults
larger_than_2 = LargerThan(FirstNumber=mass_addition.Result, SecondNumber=list_length_7)  # -> LargerThan, flatten(OrEqualTo)
cull_pattern = CullPattern(List=line_sdl_2, CullPattern=larger_than_2.OrEqualTo)
ghpython_script = GhPythonScript(x=line_sdl_2, y=cull_pattern)  # -> a; inputs x: list, y: list
# ---------- ghpython_script: Python ----------
__author__ = "DueringS"
__version__ = "2022.08.26"

import rhinoscriptsyntax as rs

if y == []:
    a = x
else:
     a = y
# ---------- end ghpython_script ----------
list_length_8 = ListLength(List=ghpython_script)
duplicate_data_7 = DuplicateData(Data=program_2, Number=list_length_8, Order=True)
lines_3 = Data(ghpython_script)

# ----
lines_4 = Data(lines_3)
programattr_2 = Data(program_2)
m_2 = Data(unit_y)
move_2 = Move(Geometry=lines_4, Motion=m_2)  # -> Geometry, Transform
merge_4 = Merge(Data1=lines_4, Data2=move_2.Geometry)  # -> flatten(Result)
list_length_9 = ListLength(List=merge_4)
duplicate_data_8 = DuplicateData(Data=programattr_2, Number=list_length_9, Order=True)
lines_5 = Data(merge_4)
type_2 = Data(duplicate_data_8)

cluster_8 = Cluster(attributekeys=horizontalmovementkeys, attributevalues=entwine, type=type_2, geometry=lines_5)  # -> userkeys, uservalues, geometry_4, elefrontattr_2, bakename

# ---- group: local highstreet
panel_9 = Panel("1")
unit_x_3 = UnitX(Factor=1)
construct_point_3 = ConstructPoint(XCoordinate=0, YCoordinate=yshift, ZCoordinate=deconstruct_2.ZComponent)
treshold_2 = Slider(10, range=1..60)

interval_3 = Data(highstreet)
dominatinglines_2 = Data([lines_5, lines_2])
program_3 = Data(panel_9)
modulelength_3 = Data(module_lenght)
offset_3 = Data(highstreet_2)
moduleheight_4 = Data(moduleheight)

division_3 = Division(A=moduleheight_4, B=interval_3)
number_3 = Number(expr("round(x-0.4)", division_3))
series_3 = Series(Start=offset_3, Step=interval_3, Count=number_3)
line_sdl_3 = LineSDL(Start=construct_point_3, Direction=unit_x_3, Length=modulelength_3)
curve_proximity_2 = CurveProximity(CurveA=graft(line_sdl_3), CurveB=dominatinglines_2)  # -> PointA, PointB, simplify(Distance)
larger_than_3 = LargerThan(FirstNumber=curve_proximity_2.Distance, SecondNumber=treshold_2)  # -> LargerThan, OrEqualTo
list_length_10 = ListLength(List=dominatinglines_2)
mass_addition_2 = MassAddition(Input=larger_than_3.OrEqualTo)  # -> Result, PartialResults
larger_than_4 = LargerThan(FirstNumber=mass_addition_2.Result, SecondNumber=list_length_10)  # -> LargerThan, flatten(OrEqualTo)
cull_pattern_2 = CullPattern(List=line_sdl_3, CullPattern=larger_than_4.OrEqualTo)
ghpython_script_2 = GhPythonScript(x=line_sdl_3, y=cull_pattern_2)  # -> a; inputs x: list, y: list; same code as ghpython_script
list_length_11 = ListLength(List=ghpython_script_2)
duplicate_data_9 = DuplicateData(Data=program_3, Number=list_length_11, Order=True)
lines_6 = Data(ghpython_script_2)

# ----
lines_7 = Data(lines_6)
programattr_3 = Data(program_3)
m_3 = Data(unit_y)
move_3 = Move(Geometry=lines_7, Motion=m_3)  # -> Geometry, Transform
merge_5 = Merge(Data1=lines_7, Data2=move_3.Geometry)  # -> flatten(Result)
list_length_12 = ListLength(List=merge_5)
duplicate_data_10 = DuplicateData(Data=programattr_3, Number=list_length_12, Order=True)
lines_8 = Data(merge_5)
type_3 = Data(duplicate_data_10)

cluster_9 = Cluster(attributekeys=horizontalmovementkeys, attributevalues=entwine, type=type_3, geometry=lines_8)  # -> userkeys, uservalues, geometry_4, elefrontattr_2, bakename
merge_6 = Merge(
    Data1=flatten(cluster_7.geometry_4),
    Data2=flatten(cluster_8.geometry_4),
    Data3=flatten(cluster_9.geometry_4),
    Data4=flatten(cluster_2.geometry_4),
    Data5=flatten(cluster_3.geometry_4),
    Data6=flatten(cluster_4.geometry_4),
    Data7=flatten(cluster_6.geometry_4),
    Data8=flatten(cluster_5.geometry_4))
entwine_2 = Entwine(
    Branch0X=cluster_7.uservalues,
    Branch1X=cluster_8.uservalues,
    Branch2X=cluster_9.uservalues,
    Branch3X=cluster_2.uservalues,
    Branch4X=cluster_3.uservalues,
    Branch5X=cluster_4.uservalues,
    Branch6X=cluster_6.uservalues,
    Branch7X=cluster_5.uservalues,
    FlattenInputs=False)  # -> simplify(Result)
path_mapper = PathMapper(entwine_2, source="{A;B}", target="{path_index}")
data_2 = Data(path_mapper)

# ----
# clone & offset
# mode specific lines
# seperate layers are optional,
# all relevant attributes are
# stored on the geometry
modeattributes_2 = Data(simplify(modeattributes))
createmodegeo = CreateModeGeo(modeattributes=modeattributes_2, offsetid="5", geo=merge_6, keys=entwine, values=data_2)  # -> parentcurveid, flatten(geometry), flatten(modes_2), simplify(flatten(modes_ids_2))
tree_branch_3 = TreeBranch(Tree=simplify(modeattributes_2), Path=flatten(createmodegeo.modes_ids_2), MaintainPaths=False)
segments = Curve(reparameterize(flatten(createmodegeo.geometry)))
parentcrvid = Data(flatten(createmodegeo.parentcurveid))

lines_9 = Data(segments)

geo = Data(segments)
atrr = Data(tree_branch_3)
max_snap_distance = Slider(9.3, range=0.5..100)

geo_2 = Data(segments)
atrr_2 = Data(tree_branch_3)
max_snap_distance_2 = Slider(9.3, range=0.5..100)

modeattr = Data(tree_branch_3)
# intersection parameter
lines_10 = Data(lines_9)
tol = Slider(0.1, range=0..1)
attr = GhPythonScript(geo=flatten(lines_10), attr=modeattr, modeID="0", intersectID="6", tolerance=tol)  # -> splitCrvsRef, flatten(splitCrvs), attrRef, paraVal, paraAttr, linesOut; inputs geo: list of Curve, attr: tree, modeID: Int32, intersectID: Int32
# ---------- attr: Python ----------
__author__ = "DueringS"
__version__ = "2022.08.29"

import rhinoscriptsyntax as rs
import Rhino
import Grasshopper
import Grasshopper.DataTree as tree
import Grasshopper.Kernel.Data.GH_Path as ghpath
import json

import ghpythonlib.components as ghcomp
snapDist = 5
tolOver = 0.0
if tolerance == None:
    tolerance = 0.001

# initialize trees for final output
splitCrvs = tree[object]()
splitCrvsAttrID = tree[object]()

# curve represented as parameter + parameter tpye
paraVal = tree[object]()
paraAttr = tree[object]()


for i, g in enumerate(geo):
    splitCrvs.Add(g, ghpath(i))
    splitCrvsAttrID.Add(i, ghpath(i))
    try:
        print attr.Branch(ghpath(i))[modeID]
    except:
        print attr.Branch(ghpath(i)), i
    # as there is always an star/end point .. 
    curAttr = attr.Branch(ghpath(i))[modeID]
    paraVal.EnsurePath(ghpath(i))
    paraAttr.EnsurePath(ghpath(i))
    #paraVal.AddRange([0,1], ghpath(i))
    #paraAttr.AddRange([curAttr+"+start",curAttr+"+end"], ghpath(i))

# create dict for each segment type (IDs) 
segTypeID = {}

for i, g in enumerate(geo):
    curAttr = attr.Branch(ghpath(i))
    curMode = curAttr[modeID]
    #create key if not exists yet 
    if curMode not in segTypeID:
        segTypeID[curMode] = []
        segTypeID[curMode].append(i)
    else:
        segTypeID[curMode].append(i)

print segTypeID

"""
1. iterate through each line/curve
2. collect intersection candidates from segTypeID dictionary
3. List to collect curve-parameter for splitting
    -> also store the type of split 
4. test curve-curve intersections 
    add intersections to curve-parameter list
5. test for angles (deriviatives)
    add to curve-parameter list
"""

crvParamTree = tree[object]()
intersectionTracker = {str(i):[] for i,_ in enumerate(geo)} 
# key-> curve ID, value -> [list mit crv IDS that had intersections with it]
# in the loop: check if ID i

for i, crv in enumerate(geo):
    curAttr = attr.Branch(ghpath(i))
    curMode = curAttr[modeID]
    intersectModes = json.loads(curAttr[intersectID])  #text to py list
    
    intersectCandidates = []
    intersectCandidatesID = []
    for j, ism in enumerate(intersectModes):
        for ismID in segTypeID[ism]:
            intersectCandidates.append(geo[ismID])
            intersectCandidatesID.append(ismID)
    # curve-curve intersections 
    for j, otherCrv in enumerate(intersectCandidates):
        if i not in intersectionTracker[str(intersectCandidatesID[j])]: #very new
            events = Rhino.Geometry.Intersect.Intersection.CurveCurve(crv, 
                                                                      otherCrv, 
                                                                      tolerance, 
                                                                      tolOver)
            try:
                for ccx in events:
                    if ccx.ParameterA != 0:
                        crvParamTree.Add(ccx.ParameterA, ghpath(i))
                        #new 
                        paraVal.Add(ccx.ParameterA, ghpath(i))
                        paraAttr.Add(attr.Branch(ghpath(i))[modeID]+"+intersected",ghpath(i))
                        intersectionTracker[str(i)].append(intersectCandidatesID[j]) # very new
            except:
                print ("something didnt work out")
        
    # check for disconuity ... not the best way for sure
    _, para = ghcomp.Discontinuity(crv, 3)
    if len(para) > 2:
        print para[0:-1]
        for curPara in para[0:-1]:
            crvParamTree.Add(curPara, ghpath(i))
            #new
            if curPara != 0 and curPara != 1:
                paraVal.Add(curPara, ghpath(i))
                paraAttr.Add(attr.Branch(ghpath(i))[modeID]+"+curve",ghpath(i))
    try:
        if crvParamTree.Branch(ghpath(i)).Count > 0: 
            res = ghcomp.Shatter(crv, crvParamTree.Branch(ghpath(i)))
            splitCrvs.RemovePath(ghpath(i))
            splitCrvs.AddRange(res, ghpath(i))
            
            splitCrvsAttrID.RemovePath(ghpath(i))
            splitCrvsAttrID.AddRange([i] * len(res), ghpath(i))
    except:
        pass
# explpde lines 

splitCrvsRef = []
attrRef = tree[object]()
cnt=0
for pth in splitCrvsAttrID.Paths:
    for id in splitCrvsAttrID.Branch(pth):
        attrRef.AddRange(attr.Branch(ghpath(id)),  ghpath(cnt))
        splitCrvsRef.append(id)
        cnt += 1
        splitCrvsRef.append(id)


#attrRef = splitCrvsAttrID

print intersectionTracker
# ---------- end attr ----------

# ----
# create station/access points
panel_10 = Panel("station")
atrr_3 = Data(tree_branch_3)
geo_3 = Data(segments)
max_snap_distance_3 = Slider(12.4, range=0.5..100)

atrr_4 = Data(tree_branch_3)
geo_4 = Data(segments)
max_snap_distance_4 = Slider(5.7, range=0.5..100)

atrr_5 = Data(tree_branch_3)
geo_5 = Data(segments)
max_snap_distance_5 = Slider(9.3, range=0.5..100)

atrr_6 = Data(tree_branch_3)
geo_6 = Data(segments)
max_snap_distance_6 = Slider(5.7, range=0.5..100)

# ----
# need to be optimized for larger model
cluster_10 = Cluster_3(
    attrname="station",
    geo=geo,
    atrr=atrr,
    keyid="0",
    val="GMT",
    fixeddistance=Slider(1600, range=10..1600),
    fixedoffset=Slider(0, range=0..1600),
    manualpts=manualpts_3,
    relay=merge_nearby,
    snapdistance=max_snap_distance)  # -> pts_2, simplify(parameter), simplify(attr_2)
cluster_11 = Cluster_3(
    attrname="station",
    geo=geo_2,
    atrr=atrr_2,
    keyid="0",
    val="HSR",
    fixeddistance=Slider(1600, range=10..1600),
    fixedoffset=Slider(0, range=0..1600),
    manualpts=manualpts_4,
    relay=merge_nearby_2,
    snapdistance=max_snap_distance_2)  # -> pts_2, simplify(parameter), simplify(attr_2)
cluster_12 = Cluster_3(
    attrname="station",
    geo=geo_4,
    atrr=atrr_4,
    keyid="0",
    val="elevatorCoreExpress",
    fixeddistance=Slider(1600, range=10..1600),
    fixedoffset=Slider(0, range=0..1600),
    manualpts=manualpts_6,
    relay=merge_nearby_4,
    snapdistance=max_snap_distance_4)  # -> pts_2, simplify(parameter), simplify(attr_2)
cluster_13 = Cluster_3(
    attrname="station",
    geo=geo_5,
    atrr=atrr_5,
    keyid="0",
    val="elevatorCoreLocal",
    fixeddistance=Slider(1600, range=10..1600),
    fixedoffset=Slider(0, range=0..1600),
    manualpts=manualpts_7,
    relay=merge_nearby_5,
    snapdistance=max_snap_distance_5)  # -> pts_2, simplify(parameter), simplify(attr_2)
cluster_14 = Cluster_3(
    attrname=panel_10,
    geo=geo_3,
    atrr=atrr_3,
    keyid="0",
    val="DRT_schedule",
    fixeddistance=Slider(379, range=10..1600),
    fixedoffset=Slider(22, range=0..1600),
    manualpts=manualpts_5,
    relay=merge_nearby_3,
    snapdistance=max_snap_distance_3)  # -> pts_2, parameter, attr_2
cluster_15 = Cluster_3(
    attrname="station",
    geo=geo_6,
    atrr=atrr_6,
    keyid="0",
    val="DRT_demand",
    fixeddistance=Slider(99, range=10..200),
    fixedoffset=Slider(0, range=0..1600),
    manualpts=manualpts_8,
    relay=merge_nearby_6,
    snapdistance=max_snap_distance_6)  # -> pts_2, parameter, attr_2

# ----
# connecting transportation modes
_1_accesspoints_pedestrian_2_pedestrian = Panel("""elevatorCoreExpress
elevatorCoreLocal
escalator
DRT_demand
DRT_schedule
GMT
HSR
activityNode
pedestrian
MM_lanes
MM_shared""")  # "1)Accesspoints->pedestrian 2) pedestrian -> shared-spaces"
modeattr_2 = Data(tree_branch_3)
merge_7 = Merge(
    Data1=attr.paraVal,
    Data2=cluster_14.parameter,
    Data3=cluster_15.parameter,
    Data4=cluster_12.parameter,
    Data5=cluster_13.parameter,
    Data6=cluster_10.parameter,
    Data7=cluster_11.parameter)  # -> simplify(Parameter)
merge_8 = Merge(
    Data1=attr.paraAttr,
    Data2=cluster_14.attr_2,
    Data3=cluster_15.attr_2,
    Data4=cluster_12.attr_2,
    Data5=cluster_13.attr_2,
    Data6=cluster_10.attr_2,
    Data7=cluster_11.attr_2)  # -> simplify(ParaAttr)
number_slider = Slider(12, range=0..100)
lines_11 = Data(lines_9)
number_slider_2 = Slider(13, range=0..100)
activitynode_snapdist_2 = Slider(12, range=0..100)
ghpython_script_3 = GhPythonScript(
    hiechary=_1_accesspoints_pedestrian_2_pedestrian,
    seg=lines_11,
    para=merge_7,
    paraAttr=merge_8,
    modeAttr=modeattr_2,
    connTarg="7",
    modeID="0",
    maxDist=maxdist,
    snapDist=snapdist,
    anPt=accesspoints_activitynodes,
    anPtAttr=anattr,
    modeAttrAll=modeattributes,
    maxDistAn=activitynode_snapdist)  # -> modeAttrOut, paraOut, paraOutAttr, connSeg, connSegAttr; inputs hiechary: list, seg: list of Curve, para: tree, paraAttr: tree, modeAttr: tree, connTarg: Int32, modeID: Int32, anPt: list of Point3d, anPtAttr: tree, modeAttrAll: tree
# ---------- ghpython_script_3: Python ----------
__author__ = "DueringS"
__version__ = "2022.08.30"

import json
import rhinoscriptsyntax as rs
import Rhino.Geometry as rg

from Rhino.Geometry import RTree

import Grasshopper.DataTree as tree
import Grasshopper.Kernel.Data.GH_Path as ghpath

import ghpythonlib.components as ghcomp

"""
hard coded parts: 

- hierachy (if not pedestrian , if pedestrian ...
- parameter generated through intersections do not establish new connections 

"""

"""
link attributes
- connection type (DRT_demand-pedestrian)
- enterTime
- exitTime
- distance
- startType
- endTyp
"""

# ==============================================================================
# ============== PARAMTER HARD-CODED  ==========================================
# ==============================================================================

#segments 
enterTimeID = 2
exitTimeID = 8

# activity nodes
pt2an = 6                   # id of attribute key that depicts  the  parentBrep/actvityNode ID for an access point
activityNodeModeAttrID = 8  # ID of mode attributes for "activityNodes"



# ==============================================================================
# ============== FUNCTIONS & UTILS  ============================================
# ==============================================================================

def tree2dict(dataTr, keyID):
    # transform a dataTree into a dictionary using
    # one the item at position "keyID" as the key in 
    # the dictionary. Allows to access objects using keys
    newDict = {}
    for i, pth in enumerate(dataTr.Paths):
        dictKey  = dataTr.Branch(pth)[keyID]
        if not dictKey in newDict:
            newDict[dictKey] = []
        newDict[dictKey].append(i)
    return newDict
 
# merge position of points
def ptlistCenter(pts):
    #gets the weighted center point of an point cloud
    ptCnt = len(pts)
    xVal = [obj.X for obj in pts]
    yVal = [obj.Y for obj in pts]
    zVal = [obj.Z for obj in pts]
    avgPt = rg.Point3d(sum(xVal)/ptCnt, sum(yVal)/ptCnt,sum(zVal)/ptCnt)
    return avgPt
    
    
def connectTarget(segIDs,paramType, paramTypeNoConnection, connName,connSegAttr, connSeg, connSegAttrCnt):
    for segID in segIDs:
        curCrv = seg[segID]
        for i, curParam in enumerate(para.Branch(ghpath(segID))):
            curParamType = paraAttr.Branch(ghpath(segID))[i].split("+")
            
            if (curParamType[1] == paramType or paramType == "") and (curParamType[1] != paramTypeNoConnection or paramTypeNoConnection == ""):
                # transform paramter to point
                curParamPt = curCrv.PointAt(curParam)
                
                for targetMode in targetModes:
                    winningDist = 9999999999
                    winningParam = -1
                    winningID = -1
                    winningPt = None
                    for candidateID in segTypeID[targetMode]:
                        candidateSeg = seg[candidateID]
                        # returns if successfull or not & paramter on curve
                        clstPtResult = candidateSeg.ClosestPoint(curParamPt,maxDist)
                        if clstPtResult[0] == True:
                            # get Point on other curve 
                            crvPt = candidateSeg.PointAt(clstPtResult[1])
                            curDistance = curParamPt.DistanceTo(crvPt)
                            if curDistance < winningDist:
                                winningDist = curDistance
                                winningParam = clstPtResult[1]
                                winningID = candidateID
                                winningPt = crvPt
                    
                    if winningPt != None:
                        # Check if there are any params/pts within radius on the
                        #curve that a connection shall established with
                        paraOutCP = paraOut#tree[object](paraOut)
                        segLen = seg[winningID].GetLength()
                        winningParPos = winningParam * segLen #instead of doing closest pt things
                        
                        existingPar = None
                        for  curPar in paraOutCP.Branch(ghpath(winningID)):
                            # for winning segment, check if there are pts within radius 
                            # currently first found pt within r is taken, not closest one
                            if abs(winningParPos - (curPar * segLen)) < snapDist:
                                existingPar = curPar
                                break 
                        
                        connSegAttr.AddRange([ curMode+"-" + targetMode,
                                             enterTime,
                                             exitTime,
                                             winningDist,
                                             targetMode,
                                             curMode
                                            ], ghpath(connSegAttrCnt))
                        # collect physical connection lines
                        if existingPar == None:
                            connSeg.append(rg.Line(winningPt, curParamPt))
                            connSegAttrCnt += 1
                            # add new paramter to target curve
                            paraOut.Add(winningParam ,ghpath(winningID))
                            paraOutAttr.Add(curMode+"+" + connName, ghpath(winningID))
                        else:
                            connSeg.append(rg.Line(seg[winningID].PointAt(existingPar), curParamPt))
                            connSegAttrCnt += 1
                        
                        
    return connSegAttr, connSeg, connSegAttrCnt

# ==============================================================================
# ============== PREPERE DATA  =================================================
# ==============================================================================

# doest matter too much
connSegAttr = tree[object]()
connSeg = []

# clone input trees for manipulation
paraOut = tree[object](para)
paraOutAttr = tree[object](paraAttr)

# create dict for each segment type (IDs) 
segTypeID = {}
connSegAttrCnt = 0

for i, g in enumerate(seg):
    curAttr = modeAttr.Branch(ghpath(i))
    curMode = curAttr[modeID]
    #create key if not exists yet 
    if curMode not in segTypeID:
        segTypeID[curMode] = []
        segTypeID[curMode].append(i)
    else:
        segTypeID[curMode].append(i)


# filter for existing modes only
hiecharyCheck = []
for obj in hiechary:
    if obj in segTypeID.keys():
        hiecharyCheck.append(obj)


# ==============================================================================
# ============== PROCESS MOBILITY SEGMENTS =====================================
# ==============================================================================

for curMode in hiecharyCheck:
    segIDs = segTypeID[curMode]
    targetModes = json.loads(modeAttr.Branch(ghpath(segIDs[0]))[connTarg])
    enterTime = modeAttr.Branch(ghpath(segIDs[0]))[enterTimeID]
    exitTime = modeAttr.Branch(ghpath(segIDs[0]))[exitTimeID]
    
    # iterate trough each segment parameter, check paramterAttr
    if curMode != "pedestrian":
        connSegAttrNew, connSegNew, connSegAttrCntNew = connectTarget(
                                              segIDs,           # segment ids to test
                                              "station",        # param type to shoot connections from ("" -> all)
                                              "intersected",    # param type to NOT shoot connections from ("" -> none)
                                              "stationLink",    # name of for newly added param 
                                              connSegAttr,      # tree with connection line attributes
                                              connSeg,          # list with connection line geometry
                                              connSegAttrCnt    # connection line count
                                              )
        connSegAttr = connSegAttrNew
        connSeg = connSegNew
        connSegAttrCnt = connSegAttrCntNew

# update para
para = tree[object](paraOut)
paraAttr = tree[object](paraOutAttr)

for curMode in hiecharyCheck:
    segIDs = segTypeID[curMode]
    targetModes = json.loads(modeAttr.Branch(ghpath(segIDs[0]))[connTarg])
    enterTime = modeAttr.Branch(ghpath(segIDs[0]))[enterTimeID]
    exitTime = modeAttr.Branch(ghpath(segIDs[0]))[exitTimeID]
    
    # iterate trough each segment parameter, check paramterAttr
    if curMode == "pedestrian":
        connSegAttrNew, connSegNew, connSegAttrCntNew = connectTarget(
                                                      segIDs,           # segment ids to test
                                                      "",               # param type to shoot connections from ("" -> all)
                                                      "",               # param type to NOT shoot connections from ("" -> none)
                                                      "mmLink",         # name of for newly added param name
                                                      connSegAttr,      # tree with connection line attributes
                                                      connSeg,          # list with connection line geometry
                                                      connSegAttrCnt    # connection line count
                                                      )
        connSegAttr = connSegAttrNew
        connSeg = connSegNew
        connSegAttrCnt = connSegAttrCntNew



# ==============================================================================
# ============== PROCESS ACTIVITY NODES ========================================
# ==============================================================================
if "activityNode" in hiechary:
    targetModes = json.loads(modeAttrAll.Branch(ghpath(activityNodeModeAttrID))[connTarg])
    enterTime = modeAttrAll.Branch(ghpath(activityNodeModeAttrID))[enterTimeID]
    exitTime = modeAttrAll.Branch(ghpath(activityNodeModeAttrID))[exitTimeID]
    print targetModes
    # activity nodes will inherent attributes from this "mobility type"
    connName = "activityNode"
    # group anPts by parentBrep/ activity Node
    anPtDict = tree2dict(anPtAttr, pt2an)
    
    #iterate through grouped points
    for anID in anPtDict:
        
        accPtIDs = anPtDict[anID] # access Point IDs for an Activity Node
        
        #get center point 
        anCenterPt = ptlistCenter([anPt[cid] for cid in accPtIDs])
        
        # itereate through each access point
        for j,accID in enumerate(accPtIDs):
            curAccPt = anPt[accID]
            curAccPtFlat = rg.Point3d(curAccPt.X, curAccPt.Y, 0)
            
            # collect all segments that are within maxDistAn range to shortlist
            # all lines (also of diff. modes) will block eachothers access 
            shortlistSeg = []
            shortlistParam = []
            shortlistID = []
            shortlistPt = []
            shortlistDistance=[]
            targetModeRef = []
            
            for targetMode in targetModes:
                for candidateID in segTypeID[targetMode]:
                    candidateSeg = seg[candidateID]
                    # returns if successfull or not & paramter on curve
                    clstPtResult = candidateSeg.ClosestPoint(curAccPt,maxDistAn)
                    if clstPtResult[0] == True:
                        shortlistSeg.append(candidateSeg)
                        shortlistParam.append(clstPtResult[1])
                        shortlistID.append(candidateID)
                        shortlistPt.append(candidateSeg.PointAt(clstPtResult[1]))
                        shortlistDistance.append(candidateSeg.PointAt(clstPtResult[1]).DistanceTo(anCenterPt))
                        targetModeRef.append(targetMode)
                    
            # test if other pedestrian lines where crossed  ---------------------------------<<<< check-is run only in 2D on a flatplane. Alternative: move accPt to height of test point on curve and test for intersection there.
            tempPlane = rg.Plane(rg.Point3d(0,0,0),rg.Vector3d(0,0,1))
            shortlistSegFlat = [rg.Curve.ProjectToPlane(cSeg,tempPlane) for cSeg in shortlistSeg]
            for k, slPT in enumerate(shortlistPt):
                slPTflat = rg.Point3d(slPT.X,slPT.Y,0)  # project point
                connLineFlat = rg.Line(curAccPtFlat,slPTflat)# connection line
                
                # !!!!! kk loop should only check of there is any intersection at all
                intersectEvent = False 
                for kk, contextLine in enumerate(shortlistSegFlat): #test intersections to all shortlisted
                    if k != kk:
                        #check type
                        if type(contextLine) == type(connLineFlat):
                            intersecRes = rg.Intersect.Intersection.LineLine(connLineFlat,contextLine)
                            if intersecRes == True:
                                intersectEvent = True
                        else:
                            intersecRes = rg.Intersect.Intersection.CurveCurve(rg.LineCurve(connLineFlat),contextLine,0.01,0.01)
                            if intersecRes.Count > 0:
                                intersectEvent = True
                 
                if intersectEvent == False:
                    # add paramter & new conection line 
                    
                    # Check if there are any params/pts within radius on the
                    #curve that a connection shall established with
                    paraOutCP = paraOut
                    segLen = shortlistSeg[k].GetLength()
                    
                    targetParPos = shortlistParam[k] * segLen #instead of doing closest pt things
                    targetID = shortlistID[k]
                    
                    existingPar = None
                    for  curPar in paraOutCP.Branch(ghpath(targetID)):
                        # for winning segment, check if there are pts within radius 
                        # currently first found pt within r is taken, not closest one
                        if abs(targetParPos - (curPar * segLen)) < snapDist:
                            existingPar = curPar
                            break 
                    
                    connSegAttr.AddRange(["ActivityNode"+"-" + targetModeRef[k],
                                         enterTime,
                                         exitTime,
                                         shortlistDistance[k],
                                         anPtAttr.Branch(ghpath(targetID))[pt2an], # activityNode brep reference (as startType)
                                         targetModeRef[k]
                                        ], ghpath(connSegAttrCnt))
                    
                    # collect physical connection lines
                    if existingPar == None:
                        connSeg.append(rg.Line(anCenterPt, shortlistPt[k])) # start for activityNode center
                        connSegAttrCnt += 1
                        # add new paramter to target curve
                        paraOut.Add(shortlistParam[k] ,ghpath(targetID))
                        paraOutAttr.Add(curMode+"+" + connName +anPtAttr.Branch(ghpath(targetID))[pt2an] , ghpath(targetID))
                    else:
                        connSeg.append(rg.Line(anCenterPt,seg[targetID].PointAt(existingPar)))
                        connSegAttrCnt += 1




# ensure each segment has at least start/end parameter
for pth in paraOut.Paths:
    pID = pth[0]
    curMode = modeAttr.Branch(ghpath(pID))[modeID]
    if paraOut.Branch(pth).Count == 0:
        paraOut.AddRange([0,1],pth)
        paraOutAttr.AddRange([curMode+"+start",curMode+"+end"],pth)
modeAttrOut = modeAttr
# ---------- end ghpython_script_3 ----------

mode_attributes_2 = Data(ghpython_script_3.modeAttrOut)
connsegattr = Data(ghpython_script_3.connSegAttr)
paroutattr = Data(ghpython_script_3.paraOutAttr)
connseg = Data(ghpython_script_3.connSeg)
parout = Data(ghpython_script_3.paraOut)
lines_12 = Data(lines_11)

grandparentcurvegeo = Data(merge_6)
grandparentcrvid = Data(flatten(parentcrvid))

# ---- group: prepare params/connection points for baking
params = Params(lines=lines_12, parout=parout, paroutattr=paroutattr)  # -> parampoints_2, attrkeys_2, attrvalues_2

# ---- group: prepare splitted segments for baking
segments_2 = Segments(
    relevant_attr=relevant_segment_attributes,
    mode_attributes_keys=modeattribute_keys,
    lines=lines_12,
    mode_attributes=mode_attributes_2,
    parout=parout)  # -> flatten(parentcurves), flatten(linesplitted_3), keys_2, result

# ---- group: prepare connection seg. for baking
cluster_16 = Cluster_4(connseg=connseg, connsegattr=connsegattr)  # -> connseg_4, attrkeys_2, attrvalues_2

# ---- group: prepare GrandParentCrvs for baking
# re-structureing; addition of attributes
cluster_17 = Cluster_6(grandparentlines=grandparentcurvegeo)  # -> grandparentlines_3, attrkey_2, attrval_2

# ---- group: prepare ParentCrvs for baking
cluster_18 = Cluster_7(
    parentcurveid=grandparentcrvid,
    mode_attributes_keys=modeattribute_keys,
    mode_attributes=mode_attributes_2,
    lines=lines_12)  # -> lines_4, attrkeys_2, attrval_2

# ----
panel_11 = Panel(cluster_16.attrkeys_2)
panel_12 = Panel(cluster_18.attrkeys_2)
panel_13 = Panel(segments_2.keys_2)
panel_14 = Panel(params.attrkeys_2)
panel_15 = Panel(cluster_17.attrkey_2)
context_print_5 = ContextPrint(GrandParentCurvesAttributes=cluster_17.attrval_2)
context_print_6 = ContextPrint(ParentCurvesAttributes=cluster_18.attrval_2)
context_print_7 = ContextPrint(ParamsPtsAttributes=params.attrvalues_2)
context_bake = ContextBake(GrandParentCurves=cluster_17.grandparentlines_3)
context_print_8 = ContextPrint(ConnSegAttributes=cluster_16.attrkeys_2)
context_print_9 = ContextPrint(SplitCrvsAttributes=segments_2.result)
context_print_10 = ContextPrint(GrandParenKeys=segments_2.keys_2)
context_print_11 = ContextPrint(ParamsPtsKeys=params.attrkeys_2)
context_bake_2 = ContextBake(ParentCurves=cluster_18.lines_4)
context_print_12 = ContextPrint(SplitCrvsKeys=segments_2.keys_2)
context_print_13 = ContextPrint(ParenKeys=cluster_18.attrkeys_2)
context_bake_3 = ContextBake(Geometry=params.parampoints_2)
context_bake_4 = ContextBake(Geometry=cluster_16.connseg_4)
context_bake_5 = ContextBake(SplitCrvs=segments_2.parentcurves)

# ==== cluster Cluster
attributekeys = ClusterInput()
attributevalues = ClusterInput()
type = ClusterInput()
geometry = ClusterInput()
attributekeys_2 = Data(attributekeys)
attributevalues_2 = Data(attributevalues)
type_2 = Data(type)
geometry_2 = Data(geometry)
tree_branch = TreeBranch(Tree=attributevalues_2, Path=type_2, MaintainPaths=False)
flip_matrix = FlipMatrix(Data=tree_branch)
define_object_attributes = DefineObjectAttributes(UserKeys=simplify(attributekeys_2), UserValues=tree_branch, Layer=type_2)  # -> simplify(Attributes)
list_item = ListItem(List=type_2, Index=0, Wrap=True)
geometry_3 = Data(geometry_2)
geometry_4 = ClusterOutput(geometry_3)
elefrontattr = Data(define_object_attributes)
uservalues = ClusterOutput(tree_branch)
userkeys = ClusterOutput(attributekeys_2)
elefrontattr_2 = ClusterOutput(elefrontattr)
bakename = ClusterOutput(list_item)

# ==== cluster CreateModeGeo
modeattributes = ClusterInput()
offsetid = ClusterInput()
geo = ClusterInput()
values = ClusterInput()
keys = ClusterInput()
modeattributes_2 = Data(modeattributes)
offsetid_2 = Data(offsetid)
geo_2 = Data(geo)

# ---- group: mode IDS
list_length = ListLength(List=keys)
series = Series(Start=0, Step=1, Count=list_length)  # -> simplify(Series)

# ---- group: getOffsets
list_item = ListItem(List=modeattributes_2, Index=offsetid_2, Wrap=True)  # -> flatten(Item)

# ----
cull_pattern = CullPattern(List=simplify(series), CullPattern=values)
cull_pattern_2 = CullPattern(List=keys, CullPattern=values)
cull_pattern_3 = CullPattern(List=list_item, CullPattern=values)
tree_statistics = TreeStatistics(Tree=cull_pattern_3)  # -> Paths, Length, Count
deconstruct_path = DeconstructPath(Branch=tree_statistics.Paths)  # -> flatten(Indices)
list_length_2 = ListLength(List=cull_pattern_3)
panel = Panel(cull_pattern)
unit_z = UnitZ(Factor=cull_pattern_3)
duplicate_data = DuplicateData(Data=simplify(graft(deconstruct_path)), Number=simplify(list_length_2), Order=True)  # -> simplify(Data)
move = Move(Geometry=simplify(graft(geo_2)), Motion=simplify(unit_z))  # -> Geometry, Transform
modes_ids = Data(simplify(cull_pattern))
modes = Data(cull_pattern_2)
parentcurveid = ClusterOutput(duplicate_data)
modes_ids_2 = ClusterOutput(modes_ids)
geometry = ClusterOutput(move.Geometry)
modes_2 = ClusterOutput(modes)

# ==== cluster Cluster_3
geo = ClusterInput()
atrr = ClusterInput()
val = ClusterInput()
fixeddistance = ClusterInput()
fixedoffset = ClusterInput()
relay = ClusterInput()
attrname = ClusterInput()
keyid = ClusterInput()
geo_2 = Data(geo)
atrr_2 = Data(atrr)
fixedoffset_2 = Data(fixedoffset)
fixeddistance_2 = Data(fixeddistance)
val_2 = Data(val)

concatenate = Concatenate(Fragment_A=val_2, A="+", Fragment_B=attrname)

ghpython_script = GhPythonScript(data=atrr_2, keyID=keyid, val=val_2)  # -> objectID; inputs data: tree, keyID: Int32
# ---------- ghpython_script: Python ----------
__author__ = "DueringS"
__version__ = "2022.08.29"

import rhinoscriptsyntax as rs
import Grasshopper
import Grasshopper.DataTree as tree
import Grasshopper.Kernel.Data.GH_Path as ghpath

objectID = []

for i, pth in enumerate(data.Paths):
    if data.Branch(pth)[keyID] == val:
        objectID.append(i)
# ---------- end ghpython_script ----------
manualpts = ClusterInput()
list_item = ListItem(List=geo_2, Index=ghpython_script, Wrap=True)
curve_closest_point = CurveClosestPoint(ManualPts=simplify(graft(manualpts)), Curve=simplify(list_item))  # -> Point, Parameter, Distance
list_length = ListLength(List=curve_closest_point.Parameter)
series = Series(Start=0, Step=1, Count=list_length)  # -> simplify(Series)
divide_length = DivideLength(Curve=list_item, Length=fixeddistance_2)  # -> simplify(Points), simplify(Tangents), simplify(Parameters)
length = Length(Curve=list_item)
sort_list = SortList(
    Keys=simplify(curve_closest_point.Distance),
    ValuesPt=simplify(curve_closest_point.Point),
    ValuesPar=simplify(curve_closest_point.Parameter),
    ValuesCrvID=series)  # -> Keys, ValuesPt, ValuesPar, ValuesCrvID
division = Division(A=fixedoffset_2, B=length)
snapdistance = ClusterInput()
list_item_2 = ListItem(List=sort_list.Keys, Index=0, Wrap=True)  # -> simplify(Item)
list_item_3 = ListItem(List=sort_list.ValuesPar, Index=0, Wrap=True)  # -> simplify(Item)
list_item_4 = ListItem(List=sort_list.ValuesCrvID, Index=0, Wrap=True)  # -> simplify(Item)
addition = Addition(A=simplify(divide_length.Parameters), B=simplify(graft(division)))
smaller_than = SmallerThan(FirstNumber=list_item_2, SecondNumber=snapdistance)  # -> SmallerThan, OrEqualTo

smaller_than_2 = SmallerThan(FirstNumber=addition, SecondNumber="1")  # -> SmallerThan, OrEqualTo

cull_pattern = CullPattern(List=addition, CullPattern=smaller_than_2.SmallerThan)  # -> simplify(List)
cull_pattern_2 = CullPattern(List=list_item_4, CullPattern=smaller_than.OrEqualTo)  # -> flatten(List)
cull_pattern_3 = CullPattern(List=list_item_3, CullPattern=smaller_than.OrEqualTo)  # -> flatten(List)
list_length_2 = ListLength(List=list_item)
ghpython_script_2 = GhPythonScript(maxBranches=list_length_2, val=cull_pattern_3, id=cull_pattern_2)  # -> out, a; inputs val: list, id: list
# ---------- ghpython_script_2: Python ----------
__author__ = "DueringS"
__version__ = "2022.08.29"

import rhinoscriptsyntax as rs
import Grasshopper.DataTree as tree
import Grasshopper.Kernel.Data.GH_Path as ghpath

a = tree[object]()
#no ensure a tree with one branch does not get killed by gh

for i in range(maxBranches):
    a.EnsurePath(ghpath(i))
for i, v in enumerate(val):
    a.Add(v, ghpath(id[i]))
# ---------- end ghpython_script_2 ----------
evaluate_curve = EvaluateCurve(Curve=simplify(graft(list_item)), Parameter=ghpython_script_2.a)  # -> Point, Tangent, Angle
evaluate_curve_2 = EvaluateCurve(Curve=simplify(graft(list_item)), Parameter=cull_pattern)  # -> Point, Tangent, Angle
suirify = Suirify(evaluate_curve_2.Point)
suirify_2 = Suirify(ghpython_script_2.a)
suirify_3 = Suirify(cull_pattern)
suirify_4 = Suirify(evaluate_curve.Point)
suirify_5 = Suirify(relay)
ghpython_script_3 = GhPythonScript(ptA=suirify, ptM=suirify_4, paraA=suirify_3, paraM=suirify_2, minDist=suirify_5)  # -> a; inputs ptA: tree of Point3d, ptM: tree of Point3d, paraA: tree, paraM: tree
# ---------- ghpython_script_3: Python ----------
__author__ = "DueringS"
__version__ = "2022.08.29"

import rhinoscriptsyntax as rs
import Grasshopper.DataTree as tree
import Grasshopper.Kernel.Data.GH_Path as ghpath
import Rhino.Geometry as rg


mergedPara = tree[object]()

for pth in ptA.Paths:
    mergedPara.EnsurePath(pth)

for i, curPth in enumerate(ptA.Paths):
    for j, pA in enumerate(ptA.Branch(curPth)):
        #test if no ptM is within minDist
        noCollision = True
        if ptM.PathExists(curPth):
            if ptM.Branch(curPth).Count > 0:
                for k, pM in enumerate(ptM.Branch(curPth)):
                    dist = pA.DistanceTo(pM)
                    print dist
                    if dist < minDist:
                        noCollision = False
        if noCollision == True:
            print curPth
            mergedPara.Add(paraA.Branch(curPth)[j], curPth)
        else:
            print "not added"

for pth in paraM.Paths:
    if paraM.Branch(pth).Count > 0:
        mergedPara.AddRange(paraM.Branch(pth), pth)

a = mergedPara
# ---------- end ghpython_script_3 ----------
clean_tree = CleanTree(RemoveNulls=True, RemoveInvalid=True, RemoveEmpty=True, Tree=ghpython_script_3)
sort_list_2 = SortList(Keys=clean_tree)  # -> Keys, ValuesValuesA
evaluate_curve_3 = EvaluateCurve(Curve=simplify(graft(list_item)), Parameter=sort_list_2.Keys)  # -> Point, Tangent, Angle
cluster = Cluster_2(attrname=concatenate, manualpts=evaluate_curve_3.Point)  # -> pts_2, simplify(attr_2)
suirify_6 = Suirify(sort_list_2.Keys)
construct_path = ConstructPath(Indices=graft(ghpython_script))  # -> simplify(Branch)
suirify_7 = Suirify(cluster.attr_2)
suirify_8 = Suirify(cluster.pts_2)
tree_statistics = TreeStatistics(Tree=suirify_8)  # -> Paths, Length, Count
replace_paths = ReplacePaths(Data=simplify(suirify_8), Search=tree_statistics.Paths, Replace=flatten(construct_path))
replace_paths_2 = ReplacePaths(Data=simplify(suirify_6), Search=tree_statistics.Paths, Replace=flatten(construct_path))
replace_paths_3 = ReplacePaths(Data=simplify(suirify_7), Search=tree_statistics.Paths, Replace=flatten(construct_path))
panel = Panel(construct_path)
pts = Data(replace_paths)
attr = Data(simplify(replace_paths_3))
parameter = ClusterOutput(replace_paths_2)
attr_2 = ClusterOutput(attr)
pts_2 = ClusterOutput(pts)

# ==== cluster Segments
relevant_attr = ClusterInput()
mode_attributes_keys = ClusterInput()
lines = ClusterInput()
mode_attributes = ClusterInput()
parout = ClusterInput()
mode_attributes_keys_2 = Data(mode_attributes_keys)
relevant_attr_2 = Data(relevant_attr)
lines_2 = Data(lines)
mode_attributes_2 = Data(mode_attributes)
parout_2 = Data(parout)
shatter = Shatter(Curve=simplify(graft(lines_2)), Parameters=parout_2)  # -> simplify(Segments)
clean_tree = CleanTree(RemoveNulls=True, RemoveInvalid=True, RemoveEmpty=True, Tree=shatter, SynchronousTree1=mode_attributes_2)  # -> Tree, SynchronousTree1
tree_branch = TreeBranch(Tree=clean_tree.Tree, Path=Slider(6, range=0..200), MaintainPaths=True)
ghpython_script = GhPythonScript(val=flatten(relevant_attr_2), keys=mode_attributes_keys_2)  # -> keyID; inputs keys: list
# ---------- ghpython_script: Python ----------
__author__ = "DueringS"
__version__ = "2022.08.29"

import rhinoscriptsyntax as rs


for i, k in enumerate(keys):
    print k, val
    if k == val:
        keyID = i
# ---------- end ghpython_script ----------
tree_statistics = TreeStatistics(Tree=clean_tree.Tree)  # -> Paths, Length, Count
deconstruct_path = DeconstructPath(Branch=tree_statistics.Paths)  # -> simplify(graft(Indices))
list_item = ListItem(List=clean_tree.SynchronousTree1, Index=ghpython_script, Wrap=True)
integer = Integer(deconstruct_path)
duplicate_data = DuplicateData(Data=integer, Number=graft(tree_statistics.Length), Order=True)  # -> simplify(Data)
panel = Panel(duplicate_data)
ghpython_script_2 = GhPythonScript(val=flatten("avg. speed"), keys=relevant_attr_2)  # -> keyID; inputs keys: list; same code as ghpython_script
tree_branch_2 = TreeBranch(Tree=list_item, Path=duplicate_data, MaintainPaths=False)  # -> simplify(Branch)
linesplitted = Data(flatten(clean_tree.Tree))
list_length = ListLength(List=linesplitted)
panel_2 = Panel("""ID
parentLineID
uuid
travelTime""")
list_item_2 = ListItem(List=tree_branch_2, Index=ghpython_script_2, Wrap=True)
length = Length(Curve=linesplitted)
linesplitted_attributes = Data(tree_branch_2)
series = Series(Start=0, Step=1, Count=list_length)
uuid_generator = GhPythonScript(x=linesplitted)  # -> a; inputs x: list
# ---------- uuid_generator: Python ----------
__author__ = "DueringS"
__version__ = "2022.09.02"

import rhinoscriptsyntax as rs
import uuid

#print uuid.uuid()


a = []
for obj in x:
    a.append(str(uuid.uuid4()))
# ---------- end uuid_generator ----------
parentlineid = Data(flatten(duplicate_data))
division = Division(A=length, B=flatten(list_item_2))
merge = Merge(Data1=flatten(relevant_attr_2), Data2=flatten(panel_2))  # -> simplify(Result)
traveltime = Number(expr("round(x,1)", division))
keys = Data(merge)
merge_2 = Merge(
    Data1=simplify(linesplitted_attributes),
    Data2=simplify(graft(series)),
    Data3=simplify(graft(parentlineid)),
    Data4=simplify(graft(uuid_generator)),
    Data5=simplify(graft(traveltime)))
curve = Curve(simplify(graft(lines_2)))
linesplitted_2 = Curve(simplify(graft(linesplitted)))
number_slider = Slider(525, range=1..1400)
parentcurves = ClusterOutput(curve)
linesplitted_3 = ClusterOutput(linesplitted_2)
result = ClusterOutput(merge_2)
keys_2 = ClusterOutput(keys)  # list of attribute names/ keys
list_item_3 = ListItem(List=merge_2, Index=Slider(5, range=0..10), Wrap=True)  # -> flatten(Item)
list_item_4 = ListItem(List=list_item_3, Index=number_slider, Wrap=True)
list_item_5 = ListItem(List=flatten(linesplitted), Index=number_slider, Wrap=True)
list_item_6 = ListItem(List=lines_2, Index=list_item_4, Wrap=True)
clean_tree_2 = CleanTree(RemoveNulls=True, RemoveInvalid=True, RemoveEmpty=True)  # -> Tree, SynchronousTree1

# ==== cluster Params
paroutattr = ClusterInput()
lines = ClusterInput()
parout = ClusterInput()
lines_2 = Data(simplify(graft(lines)))
paroutattr_2 = Data(paroutattr)
parout_2 = Data(parout)
paroutattr_3 = Data(flatten(paroutattr_2))
list_length = ListLength(List=parout_2)  # -> flatten(Length)
list_length_2 = ListLength(List=paroutattr_2)  # -> flatten(Length)
ghpython_script = GhPythonScript(splitter="+", attr=paroutattr_3)  # -> mode, type
# ---------- ghpython_script: Python ----------
__author__ = "DueringS"
__version__ = "2022.09.01"

import rhinoscriptsyntax as rs

mode, type = curParamType = attr.split(splitter)
# ---------- end ghpython_script ----------
ghpython_script_2 = GhPythonScript(x=paroutattr_2)  # -> pID; inputs x: tree
# ---------- ghpython_script_2: Python ----------
__author__ = "DueringS"
__version__ = "2022.09.02"

import rhinoscriptsyntax as rs
import Grasshopper.DataTree as tree
import Grasshopper.Kernel.Data.GH_Path as ghpath
#ghpath.indi
pths = x.Paths
pID = []
for pth in pths:
    curPth = pth.Indices[0]
    for obj in x.Branch(pth):
        pID.append(curPth)
# ---------- end ghpython_script_2 ----------
evaluate_curve = EvaluateCurve(Curve=simplify(lines_2), Parameter=parout_2)  # -> flatten(Point), Tangent, Angle
list_length_3 = ListLength(List=ghpython_script.type)
uuid_generator = GhPythonScript(x=ghpython_script.type)  # -> a; inputs x: list
# ---------- uuid_generator: Python ----------
__author__ = "DueringS"
__version__ = "2022.09.02"

import rhinoscriptsyntax as rs
import uuid

#print uuid.uuid()

my_uuid = uuid.uuid4()
a = []

for obj in x:
    a.append(str(uuid.uuid4()))
# ---------- end uuid_generator ----------
series = Series(Start=0, Step=1, Count=list_length_3)
merge = Merge(
    Data1=simplify(graft(ghpython_script.mode)),
    Data2=simplify(graft(ghpython_script.type)),
    Data3=simplify(graft(ghpython_script_2)),
    Data4=simplify(graft(series)),
    Data5=simplify(graft(uuid_generator)))  # -> simplify(Result)
merge_2 = Merge(Data1=flatten("mode"), Data2=flatten("type"), Data3=flatten("parentCurveID"), Data4=flatten("ID"), Data5=flatten("uuid"))  # -> simplify(flatten(Result))
panel = Panel(list_length_2)
parampoints = Data(evaluate_curve.Point)
attrvalues = Data(merge)
attrkeys = Data(merge_2)
parampoints_2 = ClusterOutput(parampoints)
attrkeys_2 = ClusterOutput(attrkeys)
attrvalues_2 = ClusterOutput(attrvalues)
panel_2 = Panel(paroutattr_2)

# ==== cluster Cluster_4
connsegattr = ClusterInput()
connseg = ClusterInput()
connsegattr_2 = Data(connsegattr)
connseg_2 = Data(connseg)
panel = Panel("""connectionType
avg. waiting time
exitTime
length
startType
endType
ID
uuid""")
list_length = ListLength(List=connseg_2)
series = Series(Start=0, Step=1, Count=list_length)
uuid_generator = GhPythonScript(x=connseg_2)  # -> a; inputs x: list; same code as uuid_generator
merge = Merge(Data1=simplify(connsegattr_2), Data2=simplify(graft(series)), Data3=simplify(graft(uuid_generator)))
attrvalues = Data(merge)
attrkeys = Data(panel)
connseg_3 = Data(connseg_2)
attrkeys_2 = ClusterOutput(attrkeys)
connseg_4 = ClusterOutput(connseg_3)
attrvalues_2 = ClusterOutput(attrvalues)

# ==== cluster Cluster_5
list = ClusterInput()
list_2 = ClusterInput()

# ---- group: scale offsetts
list_item = ListItem(List=list, Index="5", Wrap=True)
multiplication = Multiplication(A=list_item, B=Slider(1.1, range=0.5..10))
replace_items = ReplaceItems(List=list_2, Item=multiplication, Indices="5", Wrap=False)  # -> simplify(List)

# ----
number = Number(flatten(list_item))
create_set = CreateSet(List=number)  # -> Set, Map
integer = Integer()
member_index = MemberIndex(Set=number, Member=create_set.Set)  # -> Index, Count
list_3 = ClusterOutput(replace_items)
ghpython_script = GhPythonScript(x=member_index.Count)  # -> a; inputs x: list
# ---------- ghpython_script: Python ----------
__author__ = "DueringS"
__version__ = "2022.09.02"

import rhinoscriptsyntax as rs

cnt = 0
for obj in x:
    if obj > 1:
        cnt += 1

if cnt == 0:
    a = "All GOOD: modes have unique offsets"
else:
    a = "ATTENTION: " + str(cnt) + " mode(s) have the same line offset value"
# ---------- end ghpython_script ----------
warning = ClusterOutput(ghpython_script)

# ==== cluster Cluster_6
grandparentlines = ClusterInput()
lines = Data(grandparentlines)
list_length = ListLength(List=lines)
series = Series(Start=0, Step=1, Count=list_length)
grandparentlines_2 = Data(grandparentlines)
attrkey = Data("ID")
attrval = Data(series)
attrkey_2 = ClusterOutput(attrkey)
attrval_2 = ClusterOutput(attrval)
grandparentlines_3 = ClusterOutput(grandparentlines_2)

# ==== cluster Cluster_7
lines = ClusterInput()
parentcurveid = ClusterInput()
mode_attributes_keys = ClusterInput()
mode_attributes = ClusterInput()
lines_2 = Data(lines)
parentcurveid_2 = Data(parentcurveid)
mode_attributes_keys_2 = Data(mode_attributes_keys)
panel = Panel("""ID
uuid
GrandParentCrvID""")
list_length = ListLength(List=lines_2)
mode_attributes_2 = Data(mode_attributes)
series = Series(Start=0, Step=1, Count=list_length)
uuid_generator = GhPythonScript(x=lines_2)  # -> a; inputs x: list; same code as uuid_generator
merge = Merge(Data1=flatten(mode_attributes_keys_2), Data2=flatten(panel))
merge_2 = Merge(
    Data1=simplify(mode_attributes_2),
    Data2=simplify(graft(series)),
    Data3=simplify(graft(uuid_generator)),
    Data4=simplify(graft(parentcurveid_2)))
attrkeys = Data(merge)
attrval = Data(merge_2)
lines_3 = Data(lines_2)
attrkeys_2 = ClusterOutput(attrkeys)
attrval_2 = ClusterOutput(attrval)
lines_4 = ClusterOutput(lines_3)

# ==== cluster _220906_universalModuleBasics
num_module_width = ClusterInput()
num_number_of_modules_row = ClusterInput()
num_floor_height = ClusterInput()
num_floor_number = ClusterInput()
num_podium_height = ClusterInput()
num_number_of_floors_in_podium = ClusterInput()
num_elevator_width = ClusterInput()
num_elevator_dist_from_edge = ClusterInput()
num_elevator_interval_express = ClusterInput()
num_elevator_interval_local = ClusterInput()
num_elevator_interval_express_1st_interv = ClusterInput()  # "Num_elevator interval_express_1st interval"
num_elevator_interval_local_2nd_public_s = ClusterInput()  # "Num_elevator interval_local_2nd public street"
num_elevator_interval_local_1st_public_s = ClusterInput()  # "Num_elevator interval_local_1st public street"
num_num_of_modules_in_activity_center = ClusterInput()
num_dist_between_gmt_hrs = ClusterInput()
attributekeys = ClusterInput()
crv_ped_horiz = ClusterInput()
attributevalues = ClusterInput()

num_elevator_interval_local_2nd_public_s_2 = Number(num_elevator_interval_local_2nd_public_s)  # "Num_elevator interval_local_2nd public street"
num_elevator_interval_local_1st_public_s_2 = Number(num_elevator_interval_local_1st_public_s)  # "Num_elevator interval_local_1st public street"
num_elevator_interval_express_1st_interv_2 = Number(num_elevator_interval_express_1st_interv)  # "Num_elevator interval_express_1st interval"
num_num_of_modules_in_activity_center_2 = Number(num_num_of_modules_in_activity_center)
num_number_of_floors_in_podium_2 = Number(num_number_of_floors_in_podium)
num_dist_between_gmt_hrs_2 = Number(num_dist_between_gmt_hrs)
num_number_of_modules_row_2 = Number(num_number_of_modules_row)
num_elevator_interval_express_2 = Number(num_elevator_interval_express)
num_elevator_dist_from_edge_2 = Number(num_elevator_dist_from_edge)
num_elevator_interval_local_2 = Number(num_elevator_interval_local)
num_podium_height_2 = Number(num_podium_height)
num_elevator_width_2 = Number(num_elevator_width)
crv_ped_horiz_2 = Data(crv_ped_horiz)
num_module_width_2 = Number(num_module_width)
num_floor_number_2 = Number(num_floor_number)
num_floor_height_2 = Number(num_floor_height)
attributevalues_2 = Data(attributevalues)
attributekeys_2 = Data(attributekeys)

num_floor_height_3 = Number(num_floor_height_2)
num_floor_number_3 = Number(num_floor_number_2)
num_module_width_3 = Number(num_module_width_2)
num_podium_height_3 = Number(num_podium_height_2)
num_number_of_modules_row_3 = Number(num_number_of_modules_row_2)

swatch = ColourSwatch(SwatchColor=RGB(54, 214, 185))

panel = Panel("Elevator")

num_module_width_4 = Number(num_module_width_2)
num_elevator_width_3 = Number(num_elevator_width_2)
num_floor_height_4 = Number(num_floor_height_2)
num_floor_number_4 = Number(num_floor_number_2)
num_podium_height_4 = Number(num_podium_height_2)
num_elevator_dist_from_edge_3 = Number(num_elevator_dist_from_edge_2)

panel_2 = Panel("Module unit")
rectangle = Rectangle(Plane=PlaneXY(0, 0, 0), XSize=num_module_width_3, YSize=num_module_width_3, Radius=0)  # -> Rectangle, Length
num_module_width_5 = Number(num_module_width_3)
crv_unit_footprint = Curve(rectangle.Rectangle)
Y = UnitY(Factor=num_module_width_5)
move = Move(Geometry=crv_unit_footprint, Motion=Y)  # -> Geometry, Transform
crv = Curve(move.Geometry)
series = Series(Start=0, Step=1, Count=num_number_of_modules_row_3)
merge = Merge(Data1=crv_unit_footprint, Data2=crv)
multiplication = Multiplication(A=num_module_width_5, B=series)
crv_2 = Curve(merge)
wrap = WrapList(Data=multiplication)
lng = ListLength(List=crv_2)
graft = GraftTree(Tree=crv_2, IncludeEmptyLists=True, IncludeNullItems=True)
dup = DuplicateData(Data=wrap, Number=lng, Order=True)  # -> flatten(Data)
unwrap = UnwrapList(WrappedData=dup)
X = UnitX(Factor=unwrap)
crv_3 = Curve(graft)
translation_for_8x2_modules = Data(X)
move_2 = Move(Geometry=crv_3, Motion=translation_for_8x2_modules)  # -> Geometry, Transform
trim = TrimTree(Tree=move_2.Geometry, Depth=1)
crv_16_units_footprint = Curve(move_2.Geometry)
num_podium_height_5 = Number(num_podium_height_3)
boundary = BoundarySurfaces(Edges=crv_16_units_footprint)
Z = UnitZ(Factor=num_podium_height_5)
move_3 = Move(Geometry=boundary, Motion=Z)  # -> Geometry, Transform
srf_16_units_footprint = Surface(move_3.Geometry)
num_floor_height_5 = Number(num_floor_height_3)
num_floor_number_5 = Number(num_floor_number_3)
Z_2 = UnitZ(Factor=num_floor_height_5)
series_2 = Series(Start=0, Step=num_floor_height_3, Count=num_floor_number_5)
extr = Extrude(Base=srf_16_units_footprint, Direction=Z_2)
graft_2 = GraftTree(Tree=extr, IncludeEmptyLists=True, IncludeNullItems=True)

num_podium_height_6 = Number(num_podium_height_2)
crv_16_units_footprint_2 = Curve(crv_16_units_footprint)
num_number_of_floors_in_podium_3 = Number(num_number_of_floors_in_podium_2)

srf_16_units_footprint_2 = Surface(move_3.Geometry)
move_4 = Move(Geometry=srf_16_units_footprint_2, Motion=Z_2)  # -> Geometry, Transform
graft_3 = GraftTree(Tree=move_4.Geometry, IncludeEmptyLists=True, IncludeNullItems=True)
num_floor_translation = Number(series_2)
Z_3 = UnitZ(Factor=num_floor_translation)

Z_4 = UnitZ(Factor=num_floor_translation)
move_5 = Move(Geometry=graft_2, Motion=Z_4)  # -> Geometry, Transform
brep_module_unit = Brep(move_5.Geometry)

move_6 = Move(Geometry=graft_3, Motion=Z_3)  # -> Geometry, Transform

translation_for_8x2_modules_2 = Data(translation_for_8x2_modules)
num_floor_translation_2 = Number(num_floor_translation)
srf_16_units_footprint_3 = Surface(srf_16_units_footprint)
brep_module_unit_2 = Brep(brep_module_unit)
crv_unit_floorlines = Curve(move_6.Geometry)

num_floor_height_6 = Number(num_floor_height_2)
num_floor_number_6 = Number(num_floor_number_2)
srf_16_units_footprint_4 = Surface(srf_16_units_footprint_3)
num_num_of_modules_in_activity_center_3 = Number(num_num_of_modules_in_activity_center_2)

translation_for_8x2_modules_3 = Data(translation_for_8x2_modules)

rectangle_2 = Rectangle(Plane=PlaneXY(0, 0, 0), XSize=num_elevator_width_3, YSize=num_elevator_width_3, Radius=0)  # -> Rectangle, Length
multiplication_2 = Multiplication(A=num_floor_height_4, B=num_floor_number_4)
Y_2 = UnitY(Factor=num_elevator_dist_from_edge_3)
num_floor_height_total = Number(multiplication_2)
move_7 = Move(Geometry=rectangle_2.Rectangle, Motion=Y_2)  # -> Geometry, Transform
division = Division(A=num_module_width_4, B=2)
division_2 = Division(A=num_elevator_width_3, B=2)
addition = Addition(A=num_floor_height_total, B=num_podium_height_4)
subtraction = Subtraction(A=division, B=division_2)
X_2 = UnitX(Factor=subtraction)
move_8 = Move(Geometry=move_7.Geometry, Motion=X_2)  # -> Geometry, Transform
num_floor_height_total_2 = Number(addition)
crv_elevator_footprint = Curve(move_8.Geometry)
translation_for_8x2_modules_4 = Data(translation_for_8x2_modules_3)
num_floor_height_total_3 = Number(num_floor_height_total_2)
Z_5 = UnitZ(Factor=num_floor_height_total_3)

panel_3 = Panel("Podium")
trim_2 = TrimTree(Tree=crv_16_units_footprint_2, Depth=1)
division_3 = Division(A=num_podium_height_6, B=num_number_of_floors_in_podium_3)
runion = RegionUnion(Curves=trim_2)
simplify = SimplifyCurve(Curve=runion)  # -> Curve, Simplified
num_podium_height_sub_floor = Number(division_3)
num_number_of_floors_in_podium_4 = Number(num_number_of_floors_in_podium_2)
crv_podium_footprint = Curve(simplify.Curve)
series_3 = Series(Start=0, Step=num_podium_height_sub_floor, Count=num_number_of_floors_in_podium_4)
Z_6 = UnitZ(Factor=series_3)
boundary_2 = BoundarySurfaces(Edges=crv_podium_footprint)
Z_7 = UnitZ(Factor=num_podium_height_sub_floor)
extr_2 = Extrude(Base=boundary_2, Direction=Z_7)

podium_translation = Data(Z_6)

move_9 = Move(Geometry=extr_2, Motion=podium_translation)  # -> Geometry, Transform

num_podium_height_sub_floor_2 = Number(num_podium_height_sub_floor)
crv_podium_footprint_2 = Curve(crv_podium_footprint)
podium_translation_2 = Data(podium_translation)
brep_podium = Brep(move_9.Geometry)

# ----
# Central line & plane & spine
crv_podium_footprint_3 = Curve(crv_podium_footprint_2)
explode = Explode(Curve=crv_podium_footprint_3, Recursive=True)  # -> Segments, Vertices
len = Length(Curve=explode.Segments)
sort = SortList(Keys=len, ValuesA=explode.Segments)  # -> Keys, ValuesA
item = ListItem(List=sort.ValuesA, Index=0, Wrap=True)  # -> Item, Item1
midpt = CurveMiddle(Curve=item.Item1)
midpt_2 = CurveMiddle(Curve=item.Item)
ln = Line(StartPoint=midpt_2, EndPoint=midpt)
crv_footprint_centerline = Curve(ln)
midpt_3 = CurveMiddle(Curve=crv_footprint_centerline)
Z_8 = UnitZ(Factor=1)
midpt_4 = CurveMiddle(Curve=crv_footprint_centerline)
pl = ConstructPlane(Origin=midpt_3, XAxis=crv_footprint_centerline, YAxis=Z_8)

crv_footprint_centerline_2 = Curve(crv_footprint_centerline)
crv_spine_central_line = Curve(crv_footprint_centerline)
pln_center_plane = Plane(pl)
pt_gmt_station = Point(midpt_4)

pln_center_plane_2 = Plane(pln_center_plane)

pln_center_plane_3 = Plane(pln_center_plane_2)
mirror = Mirror(Geometry=crv_elevator_footprint, Plane=pln_center_plane_3)  # -> Geometry, Transform
crv_elevator_footprint_2 = Curve(flatten(mirror.Geometry))
merge_2 = Merge(Data1=crv_elevator_footprint, Data2=crv_elevator_footprint_2)
graft_4 = GraftTree(Tree=merge_2, IncludeEmptyLists=True, IncludeNullItems=True)
move_10 = Move(Geometry=graft_4, Motion=translation_for_8x2_modules_4)  # -> Geometry, Transform
crv_elevators_footprint = Curve(move_10.Geometry)
boundary_3 = BoundarySurfaces(Edges=crv_elevators_footprint)
extr_3 = Extrude(Base=boundary_3, Direction=Z_5)
brep_elevators = Brep(extr_3)

crv_elevators_footprint_2 = Curve(crv_elevators_footprint)
num_floor_height_total_4 = Number(num_floor_height_total_2)
brep_elevators_2 = Brep(brep_elevators)

num_floor_height_7 = Number(num_floor_height_2)
num_floor_number_7 = Number(num_floor_number_2)
num_podium_height_7 = Number(num_podium_height_2)
num_floor_translation_3 = Number(num_floor_translation_2)
crv_elevators_footprint_3 = Curve(crv_elevators_footprint_2)
num_floor_height_total_5 = Number(num_floor_height_total_4)
num_elevator_interval_local_3 = Number(num_elevator_interval_local_2)
num_elevator_interval_express_3 = Number(num_elevator_interval_express_2)
num_number_of_floors_in_podium_5 = Number(num_number_of_floors_in_podium_2)
num_elevator_interval_express_1st_interv_3 = Number(num_elevator_interval_express_1st_interv_2)  # "Num_elevator interval_express_1st interval"
num_elevator_interval_local_1st_public_s_3 = Number(num_elevator_interval_local_1st_public_s_2)  # "Num_elevator interval_local_1st public street"
num_elevator_interval_local_2nd_public_s_3 = Number(num_elevator_interval_local_2nd_public_s_2)  # "Num_elevator interval_local_2nd public street"

panel_4 = Panel("Elevator centerline & stops")
podium_translation_3 = Data(podium_translation_2)
num_podium_height_sub_floor_3 = Number(num_podium_height_sub_floor_2)
graft_5 = GraftTree(Tree=crv_elevators_footprint_3, IncludeEmptyLists=True, IncludeNullItems=True)
podium_translation_4 = Data(podium_translation_3)
num_elevator_interval_local_4 = Number(num_elevator_interval_local_3)
Z_9 = UnitZ(Factor=num_floor_height_total_5)
area = Area(Geometry=graft_5)  # -> Area, Centroid
Z_10 = UnitZ(Factor=num_floor_translation_3)
Z_11 = UnitZ(Factor=num_podium_height_7)
num_elevator_interval_express_1st_interv_4 = Number(num_elevator_interval_express_1st_interv_3)  # "Num_elevator interval_express_1st interval"
num_elevator_interval_local_2nd_public_s_4 = Number(num_elevator_interval_local_2nd_public_s_3)  # "Num_elevator interval_local_2nd public street"
num_elevator_interval_local_1st_public_s_4 = Number(num_elevator_interval_local_1st_public_s_3)  # "Num_elevator interval_local_1st public street"
num_floor_number_8 = Number(num_floor_number_7)
pt_elev_ctr_ground_floor = Point(area.Centroid)
multiplication_3 = Multiplication(A=num_elevator_interval_local_4, B=num_elevator_interval_express_1st_interv_4)
multiplication_4 = Multiplication(A=num_elevator_interval_local_4, B=num_elevator_interval_local_2nd_public_s_4)
multiplication_5 = Multiplication(A=num_elevator_interval_local_4, B=num_elevator_interval_local_1st_public_s_4)
move_11 = Move(Geometry=pt_elev_ctr_ground_floor, Motion=Z_9)  # -> Geometry, Transform
move_12 = Move(Geometry=pt_elev_ctr_ground_floor, Motion=Z_11)  # -> Geometry, Transform
move_13 = Move(Geometry=pt_elev_ctr_ground_floor, Motion=podium_translation_4)  # -> Geometry, Transform
subtraction_2 = Subtraction(A=num_floor_number_8, B=multiplication_3)
num_elevator_local_1st_public_street_lev = Number(multiplication_5)  # "Num_elevator_local_1st public street_level"
num_elevator_local_2nd_public_street_lev = Number(multiplication_4)  # "Num_elevator_local_2nd public street level"
num_elevator_express_1st_interval = Number(subtraction_2)
pt_elev_ctr_level_0 = Point(move_11.Geometry)
pt_elev_ctr_podium_levels = Point(move_13.Geometry)
pt_elev_ctr_level_115 = Point(move_12.Geometry)
move_14 = Move(Geometry=pt_elev_ctr_level_115, Motion=Z_10)  # -> Geometry, Transform
rev = ReverseList(List=move_14.Geometry)
pt_elev_ctr_floor_levels_1_115 = Point(rev)
num_floor_number_9 = Number(num_floor_number_7)
ln_2 = Line(StartPoint=pt_elev_ctr_ground_floor, EndPoint=pt_elev_ctr_level_0)
num_elevator_interval_local_5 = Number(num_elevator_interval_local_3)
num_elevator_interval_express_4 = Number(num_elevator_interval_express_3)
num_elevator_local_last_interval = Number(num_elevator_local_2nd_public_street_lev)
num_elevator_express_1st_interval_2 = Number(num_elevator_express_1st_interval)
num_elevator_local_1st_public_street_lev_2 = Number(num_elevator_local_1st_public_street_lev)  # "Num_elevator_local_1st public street_level"
pt_elev_ctr_floor_levels_1_115_2 = Point(pt_elev_ctr_floor_levels_1_115)
pt_elev_ctr_podium_levels_2 = Point(pt_elev_ctr_podium_levels)
pt_elev_ctr_level_0_2 = Point(pt_elev_ctr_level_0)
crv_elevator_centerline = Curve(ln_2)
division_4 = Division(A=num_elevator_express_1st_interval_2, B=num_elevator_interval_express_4)
division_5 = Division(A=num_floor_number_9, B=num_elevator_interval_local_5)
neg = Negative(Value=num_elevator_interval_express_4)
merge_3 = Merge(Data1=pt_elev_ctr_level_0_2, Data2=pt_elev_ctr_floor_levels_1_115_2, Data3=pt_elev_ctr_podium_levels_2)
merge_4 = Merge(Data1=pt_elev_ctr_level_0_2, Data2=pt_elev_ctr_floor_levels_1_115_2)
round = Round(Number=division_4)  # -> Nearest, Floor, Ceiling
round_2 = Round(Number=division_5)  # -> Nearest, Floor, Ceiling
crv_elevator_centerline_2 = Curve(crv_elevator_centerline)
pt_elev_ctr_level_115_2 = Point(pt_elev_ctr_level_115)
series_4 = Series(Start=num_elevator_local_last_interval, Step=num_elevator_interval_express_4, Count=round.Ceiling)
pt_elev_ctr_all_levels_0_115 = Point(merge_4)
series_5 = Series(Start=num_elevator_local_last_interval, Step=num_elevator_interval_local_5, Count=round_2.Floor)
pt_elev_ctr_all_levels_0_115_podium = Point(merge_3)
crv_cp = CurveClosestPoint(Point=pt_elev_ctr_level_115_2, Curve=crv_elevator_centerline_2)  # -> Point, Parameter, Distance
merge_5 = Merge(Data1=num_elevator_local_1st_public_street_lev_2, Data2=series_5)  # -> flatten(Result)
num_elevator_local_1st_public_street_lev_3 = Number(num_elevator_local_1st_public_street_lev_2)  # "Num_elevator_local_1st public street_level"
data_elevator_stop_levels_express = Data(series_4)
data_elevator_stop_levels_express_2 = Data(merge_5)
pt_elev_ctr_all_levels_0_115_2 = Point(pt_elev_ctr_all_levels_0_115)
item_2 = ListItem(List=pt_elev_ctr_all_levels_0_115_2, Index=data_elevator_stop_levels_express, Wrap=True)
item_3 = ListItem(List=pt_elev_ctr_all_levels_0_115_2, Index=data_elevator_stop_levels_express_2, Wrap=True)
item_4 = ListItem(List=pt_elev_ctr_all_levels_0_115_2, Index=num_elevator_local_1st_public_street_lev_3, Wrap=True)
points = PointList(Points=pt_elev_ctr_all_levels_0_115)
pt_elev_ctr_local = Point(item_3)
pt_elev_ctr_level_0_3 = Point(pt_elev_ctr_level_0)
pt_elev_ctr_express_main_mobility_corr = Point(item_2)
item_5 = ListItem(List=pt_elev_ctr_local, Index=0, Wrap=True)  # -> Item1, Item
crv_elevator_centerline_3 = Curve(crv_elevator_centerline)
pt_elev_ctr_ground_floor_2 = Point(pt_elev_ctr_ground_floor)
pt_elev_ctr_local_1st_public_street = Point(item_4)
pt_elev_ctr_local_1st_public_street_2 = Point(pt_elev_ctr_local_1st_public_street)
crv_cp_2 = CurveClosestPoint(Point=pt_elev_ctr_local_1st_public_street_2, Curve=crv_elevator_centerline_2)  # -> Point, Parameter, Distance
merge_6 = Merge(Data1=crv_cp_2.Parameter, Data2=crv_cp.Parameter)
shatter = Shatter(Curve=crv_elevator_centerline_2, Parameters=merge_6)
trim_3 = TrimTree(Tree=shatter, Depth=1)
crv_elevator_centerline_4 = Curve(trim_3)
midpt_5 = CurveMiddle(Curve=crv_elevator_centerline_4)
pdecon = Deconstruct(Point=midpt_5)  # -> XComponent, YComponent, ZComponent
merge_7 = Merge(Data1=item_5.Item1, Data2=item_5.Item)
sort_2 = SortList(Keys=pdecon.ZComponent, ValuesA=crv_elevator_centerline_4)  # -> Keys, ValuesA
pt_elev_ctr_local_bottom = Point(item_5.Item1)
merge_8 = Merge(Data1=pt_elev_ctr_level_0_3, Data2=pt_elev_ctr_local, Data3=pt_elev_ctr_ground_floor_2)
item_6 = ListItem(List=sort_2.ValuesA, Index=0, Wrap=True)  # -> Item, Item1, Item2
merge_9 = Merge(Data1=pt_elev_ctr_express_main_mobility_corr, Data2=merge_7)
pdecon_2 = Deconstruct(Point=merge_9)  # -> XComponent, YComponent, ZComponent
sort_3 = SortList(Keys=pdecon_2.ZComponent, ValuesA=merge_9)  # -> Keys, reverse(ValuesA)
crv_elevator_centerline_0_5 = Curve(item_6.Item2)
crv_elevator_centerline_5_115 = Curve(item_6.Item1)
crv_elevator_centerline_5_115_2 = Curve(crv_elevator_centerline_5_115)
crv_cp_3 = CurveClosestPoint(Point=pt_elev_ctr_express_main_mobility_corr, Curve=crv_elevator_centerline_5_115_2)  # -> Point, Parameter, Distance
crv_cp_4 = CurveClosestPoint(Point=pt_elev_ctr_local, Curve=crv_elevator_centerline_5_115_2)  # -> Point, Parameter, Distance
shatter_2 = Shatter(Curve=crv_elevator_centerline_5_115_2, Parameters=crv_cp_3.Parameter)
crv_elevator_centerline_115 = Curve(item_6.Item)
shatter_3 = Shatter(Curve=crv_elevator_centerline_5_115_2, Parameters=crv_cp_4.Parameter)
pt_elev_ctr_express = Point(sort_3.ValuesA)
trim_4 = TrimTree(Tree=shatter_2, Depth=1)
trim_5 = TrimTree(Tree=shatter_3, Depth=1)
crv_elev_nodes_express = Curve(trim_4)
crv_elev_nodes_local = Curve(trim_5)
crv_elevator_centerline_0_5_2 = Curve(crv_elevator_centerline_0_5)
crv_elevator_centerline_115_2 = Curve(crv_elevator_centerline_115)
panel_5 = Panel("""0
-1""")
crv_elev_nodes_express_2 = Curve(crv_elev_nodes_express)
item_7 = ListItem(List=crv_elev_nodes_express_2, Index=0, Wrap=True)  # -> Item1, Item
cull_i = CullIndex(List=crv_elev_nodes_express_2, Indices=panel_5, Wrap=True)
crv_4 = Curve(item_7.Item1)
crv_5 = Curve(item_7.Item)
merge_10 = Merge(Data1=crv_elevator_centerline_115_2, Data2=crv_elev_nodes_express_2, Data3=crv_elevator_centerline_0_5_2)
merge_11 = Merge(Data1=crv_elev_nodes_local, Data2=crv_elevator_centerline_0_5_2, Data3=crv_elevator_centerline_115_2)
trim_6 = TrimTree(Tree=cull_i, Depth=1)
merge_12 = Merge(Data1=crv_4, Data2=crv_elevator_centerline_0_5_2)
merge_13 = Merge(Data1=crv_5, Data2=crv_elevator_centerline_115_2)
crv_6 = Curve(trim_6)
join = JoinCurves(Curves=merge_12, Preserve=False)
join_2 = JoinCurves(Curves=merge_13, Preserve=False)
trim_7 = TrimTree(Tree=join, Depth=1)
trim_8 = TrimTree(Tree=join_2, Depth=1)
simplify_2 = SimplifyCurve(Curve=trim_8)  # -> Curve, Simplified
simplify_3 = SimplifyCurve(Curve=trim_7)  # -> Curve, Simplified
crv_7 = Curve(crv_6)
crv_8 = Curve(trim_8)
crv_9 = Curve(trim_7)
explode_2 = Explode(Curve=merge_10, Recursive=True)  # -> Segments, Vertices
merge_14 = Merge(Data1=crv_8, Data2=crv_7, Data3=crv_9)

crv_ped_horiz_3 = Data(crv_ped_horiz_2)
num_podium_height_8 = Number(num_podium_height_2)
crv_podium_footprint_4 = Curve(crv_podium_footprint_2)

crv_spine_central_line_2 = Curve(crv_spine_central_line)
num_dist_between_gmt_hrs_3 = Number(num_dist_between_gmt_hrs_2)

panel_6 = Panel("GMT & HRS")
division_6 = Division(A=num_dist_between_gmt_hrs_3, B="2")
neg_2 = Negative(Value=division_6)
offset = OffsetCurve(Curve=crv_spine_central_line_2, Distance=division_6, Corners=1)
offset_2 = OffsetCurve(Curve=crv_spine_central_line_2, Distance=neg_2, Corners=1)
midpt_6 = CurveMiddle(Curve=offset_2)
midpt_7 = CurveMiddle(Curve=offset)

# ----
# Pedestrian links in podium above GMT & HRS
explode_3 = Explode(Curve=crv_podium_footprint_4, Recursive=True)  # -> Segments, Vertices
Z_12 = UnitZ(Factor=num_podium_height_8)
midpt_8 = CurveMiddle(Curve=crv_ped_horiz_3)
getua = GetUserAttributes(Geometry=crv_ped_horiz_3)  # -> Keys, Values, BakeName
len_2 = Length(Curve=explode_3.Segments)
pdecon_3 = Deconstruct(Point=midpt_8)  # -> XComponent, YComponent, ZComponent
sort_4 = SortList(Keys=pdecon_3.ZComponent, ValuesA=crv_ped_horiz_3)  # -> Keys, ValuesA
sort_5 = SortList(Keys=len_2, ValuesA=explode_3.Segments)  # -> Keys, ValuesA
item_8 = ListItem(List=sort_4.ValuesA, Index=0, Wrap=True)  # -> Item, Item1
item_9 = ListItem(List=sort_5.ValuesA, Index=0, Wrap=True)  # -> Item2, Item1, Item
merge_15 = Merge(Data1=item_8.Item, Data2=item_8.Item1)
merge_16 = Merge(Data1=item_9.Item2, Data2=item_9.Item1)
crv_podium_footprint_long_sides = Curve(merge_16)
move_15 = Move(Geometry=crv_podium_footprint_long_sides, Motion=Z_12)  # -> Geometry, Transform
crv_pedestrian_podium_above_gmt_hrs = Curve(merge_15)
midpt_9 = CurveMiddle(Curve=crv_pedestrian_podium_above_gmt_hrs)
item_10 = ListItem(List=midpt_9, Index=0, Wrap=True)  # -> Item, Item1
ln_3 = Line(StartPoint=item_10.Item, EndPoint=item_10.Item1)
pt_pedestrian_podium_above_gmt_hrs = Point(midpt_9)
merge_17 = Merge(Data1=crv_pedestrian_podium_above_gmt_hrs, Data2=ln_3)

pt_gmt_station_2 = Point(midpt_7)
pt_hrs_station = Point(midpt_6)
crv_gmt_line = Curve(offset)
crv_hrs_line = Curve(offset_2)

pt_elev_ctr_all_levels_0_115_podium_2 = Point(pt_elev_ctr_all_levels_0_115_podium)
pt_elev_ctr_express_main_mobility_corr_2 = Point(pt_elev_ctr_express_main_mobility_corr)
crv_elev_nodes_local_express = Curve(merge_14)
pt_elev_ctr_floor_levels_1_115_3 = Point(pt_elev_ctr_floor_levels_1_115)
pt_elev_ctr_all_levels_0_115_3 = Point(pt_elev_ctr_all_levels_0_115)
pt_elev_ctr_podium_levels_3 = Point(pt_elev_ctr_podium_levels)
pt_elev_ctr_local_bottom_2 = Point(pt_elev_ctr_local_bottom)
crv_elev_nodes_express_3 = Curve(crv_elev_nodes_express)
crv_elevator_centerline_5 = Curve(crv_elevator_centerline)
crv_elev_nodes_local_2 = Curve(merge_11)
pt_elev_ctr_level_115_3 = Point(pt_elev_ctr_level_115)
pt_elev_ctr_express_2 = Point(pt_elev_ctr_express)
pt_elev_ctr_local_2 = Point(merge_8)

midpt_10 = CurveMiddle(Curve=ln_3)
merge_18 = Merge(Data1=pt_pedestrian_podium_above_gmt_hrs, Data2=midpt_10)

number_slider = Slider(0, range=0..100)
pt_elev_ctr_local_3 = Point(pt_elev_ctr_local_2)
pln_center_plane_4 = Plane(pln_center_plane)
crv_elev_nodes_local_3 = Curve(crv_elev_nodes_local_2)
crv_elevator_centerline_6 = Curve(crv_elevator_centerline_5)
crv_elev_nodes_local_express_2 = Curve(crv_elev_nodes_local_express)

crv_pedestrian_podium_above_gmt_hrs_2 = Curve(ln_3)
pt_pedestrian_podium_above_gmt_hrs_2 = Point(merge_18)

explode_4 = Explode(Curve=crv_elev_nodes_local_express_2, Recursive=True)  # -> Segments, Vertices

pt_elev_ctr_local_bottom_3 = Point(simplify(pt_elev_ctr_local_bottom_2))
pt_elev_ctr_express_main_mobility_corr_3 = Point(simplify(pt_elev_ctr_express_main_mobility_corr_2))

panel_7 = Panel("Bridges")
path_mapper = PathMapper(pt_elev_ctr_local_bottom_3, source="{A;B}(i)", target="{B;i}(A)")
path_mapper_2 = PathMapper(pt_elev_ctr_express_main_mobility_corr_3, source="{A;B}(i)", target="{B;i}(A)")
pt_elev_ctr_express_main_mobility_corr_4 = Point(path_mapper)
pt_elev_ctr_express_main_mobility_corr_5 = Point(path_mapper_2)
item_11 = ListItem(List=pt_elev_ctr_express_main_mobility_corr_4, Index=0, Wrap=True)  # -> Item1, Item
item_12 = ListItem(List=pt_elev_ctr_express_main_mobility_corr_5, Index=0, Wrap=True)  # -> Item1, Item
ln_4 = Line(StartPoint=item_11.Item1, EndPoint=item_11.Item)
ln_5 = Line(StartPoint=item_12.Item1, EndPoint=item_12.Item)
trim_9 = TrimTree(Tree=ln_4, Depth=1)
trim_10 = TrimTree(Tree=ln_5, Depth=1)

pt_elev_ctr_local_4 = Point(pt_elev_ctr_local_3)

crv_bridges = Curve(trim_10)
crv_bridge_bottom = Curve(trim_9)

number_slider_2 = Slider(11, range=0..30)
unit_x = UnitX(Factor=Slider(-15, range=-100..100))
move_16 = Move(Geometry=crv_bridges, Motion=unit_x)  # -> Geometry, Transform
extend_curve = ExtendCurve(Curve=move_16.Geometry, Type=0, Start=number_slider_2, End=number_slider_2)

number_slider_3 = Slider(11, range=0..30)
unit_x_2 = UnitX(Factor=Slider(-15, range=-100..100))
move_17 = Move(Geometry=crv_bridge_bottom, Motion=unit_x_2)  # -> Geometry, Transform
extend_curve_2 = ExtendCurve(Curve=move_17.Geometry, Type=0, Start=number_slider_3, End=number_slider_3)

# ----
# Activity centers (minimum units)
division_7 = Division(A=num_floor_number_6, B=num_num_of_modules_in_activity_center_3)
multiplication_6 = Multiplication(A=num_floor_height_6, B=num_num_of_modules_in_activity_center_3)
round_3 = Round(Number=division_7)  # -> Nearest, Floor, Ceiling
num_activity_center_height = Number(multiplication_6)
subtraction_3 = Subtraction(A=division_7, B=round_3.Floor)
srf_16_units_footprint_5 = Surface(srf_16_units_footprint_4)
Z_13 = UnitZ(Factor=num_activity_center_height)
series_6 = Series(Start=0, Step=num_activity_center_height, Count=round_3.Floor)
multiplication_7 = Multiplication(A=num_num_of_modules_in_activity_center_3, B=subtraction_3)
num_activity_center_height_2 = Number(num_activity_center_height)
item_13 = ListItem(List=series_6, Index=0, Wrap=True)  # -> Item1, Item
extr_4 = Extrude(Base=srf_16_units_footprint_5, Direction=Z_13)
num_rest_floors = Number(multiplication_7)
Z_14 = UnitZ(Factor=series_6)
addition_2 = Addition(A=item_13.Item1, B=num_activity_center_height_2)
Z_15 = UnitZ(Factor=addition_2)
srf_16_units_footprint_6 = Surface(srf_16_units_footprint_4)
brep = Brep(graft(extr_4))
move_18 = Move(Geometry=brep, Motion=Z_14)  # -> Geometry, Transform
move_19 = Move(Geometry=srf_16_units_footprint_6, Motion=Z_15)  # -> Geometry, Transform
brep_2 = Brep(move_18.Geometry)
srf_16_units_footprint_7 = Surface(move_19.Geometry)
num_rest_floors_2 = Number(num_rest_floors)
num_floor_height_8 = Number(num_floor_height_6)
multiplication_8 = Multiplication(A=num_rest_floors_2, B=num_floor_height_8)
Z_16 = UnitZ(Factor=multiplication_8)

graft_6 = GraftTree(Tree=srf_16_units_footprint_7, IncludeEmptyLists=True, IncludeNullItems=True)

larger = LargerThan(FirstNumber=multiplication_8, SecondNumber=0)  # -> LargerThan, OrEqualTo

extr_5 = Extrude(Base=graft_6, Direction=Z_16)
brep_3 = Brep(extr_5)

filter = StreamFilter(Gate=larger.LargerThan, Stream1=brep_3)

merge_19 = Merge(Data1=brep_2, Data2=filter)
brep_activity_centers = Brep(simplify(merge_19))

# ----
# Offset local elevator lines for the preview_1
number_slider_4 = Slider(10, range=0..100)
lng_2 = ListLength(List=crv_elev_nodes_local_express_2)
midpt_11 = CurveMiddle(Curve=crv_elev_nodes_local_3)
midpt_12 = CurveMiddle(Curve=crv_elev_nodes_local_express_2)
merge_20 = Merge(Data1=number_slider_4, Data2=Slider(6, range=0..100))
project = Project(Geometry=midpt_12, Plane=pln_center_plane_4)  # -> Geometry, Transform
project_2 = Project(Geometry=pt_elev_ctr_local_3, Plane=pln_center_plane_4)  # -> Geometry, Transform
project_3 = Project(Geometry=midpt_11, Plane=pln_center_plane_4)  # -> Geometry, Transform
lng_3 = ListLength(List=merge_20)
ln_6 = Line(StartPoint=pt_elev_ctr_local_3, EndPoint=project_2.Geometry)
ln_7 = Line(StartPoint=midpt_11, EndPoint=project_3.Geometry)
ln_8 = Line(StartPoint=midpt_12, EndPoint=project.Geometry)
division_8 = Division(A=lng_2, B=lng_3)
amp = Amplitude(Vector=ln_6, Amplitude=number_slider)
amp_2 = Amplitude(Vector=ln_7, Amplitude=number_slider)
amp_3 = Amplitude(Vector=ln_8, Amplitude=number_slider)
round_4 = Round(Number=division_8)  # -> Nearest, Floor, Ceiling
move_20 = Move(Geometry=pt_elev_ctr_local_3, Motion=amp)  # -> Geometry, Transform
move_21 = Move(Geometry=crv_elev_nodes_local_3, Motion=amp_2)  # -> Geometry, Transform
move_22 = Move(Geometry=crv_elev_nodes_local_express_2, Motion=amp_3)  # -> Geometry, Transform
dup_2 = DuplicateData(Data=merge_20, Number=round_4.Ceiling, Order=True)
trim_11 = TrimTree(Tree=dup_2, Depth=1)
X_3 = UnitX(Factor=trim_11)

move_23 = Move(Geometry=pt_elev_ctr_local_4, Motion=amp_3)  # -> Geometry, Transform
crv_10 = Curve(move_22.Geometry)
pt_elev_ctr_local_5 = Point(move_23.Geometry)

move_24 = Move(Geometry=crv_10, Motion=X_3)  # -> Geometry, Transform

move_25 = Move(Geometry=pt_elev_ctr_local_5, Motion=X_3)  # -> Geometry, Transform
wrap_2 = WrapList(Data=pt_elev_ctr_local_5, HasNameParameter=False)
crv_elev_nodes_local_moved = Curve(move_24.Geometry)
pt_elev_ctr_local_6 = Point(move_25.Geometry)

pt_elev_ctr_local_7 = Point(pt_elev_ctr_local_3)
crv_elev_nodes_local_moved_unshattered = Curve(crv_elev_nodes_local_moved)
crv_elev_nodes_local_moved_2 = Curve(crv_elev_nodes_local_moved_unshattered)
crv_cp_5 = CurveClosestPoint(Point=flatten(pt_elev_ctr_local_7), Curve=graft(crv_elev_nodes_local_moved_unshattered))  # -> Point, Parameter, Distance
graft_7 = GraftTree(Tree=crv_elev_nodes_local_moved_2, IncludeEmptyLists=True, IncludeNullItems=True)
pt = Point(crv_cp_5.Point)
pt_2 = Point(simplify(pt))

trim_12 = TrimTree(Tree=pt_2, Depth=1)

cullpt = CullDuplicates(Points=trim_12, Tolerance=0.1, CullMode=3)  # -> simplify(Points), Indices, Valence
pt_3 = Point(cullpt.Points)
trim_13 = TrimTree(Tree=pt_3, Depth=1)
crv_cp_6 = CurveClosestPoint(Point=trim_13, Curve=graft_7)  # -> Point, Parameter, Distance
shatter_4 = Shatter(Curve=graft_7, Parameters=crv_cp_6.Parameter)
trim_14 = TrimTree(Tree=shatter_4, Depth="2")

pt_elev_ctr_local_8 = Point(pt_3)

crv_elev_nodes_local_moved_1 = Curve(trim_14)
crv_elev_nodes_local_moved_3 = Curve(move_21.Geometry)
pt_elev_ctr_local_moved = Point(pt_elev_ctr_local_8)

panel_8 = Panel("Local elevator stations")
crv_elev_nodes_local_moved_1_2 = Curve(crv_elev_nodes_local_moved_1)
explode_5 = Explode(Curve=crv_elev_nodes_local_moved_1_2, Recursive=True)  # -> Segments, Vertices
pt_4 = Point(simplify(explode_5.Vertices))
trim_15 = TrimTree(Tree=pt_4, Depth=1)
cullpt_2 = CullDuplicates(Points=trim_15, Tolerance=0.1, CullMode=3)  # -> simplify(Points), Indices, Valence
pt_5 = Point(cullpt_2.Points)
pt_elev_ctr_local_9 = Point(pt_5)

crv_pedestrian_podium_above_gmt_hrs_3 = Curve(crv_pedestrian_podium_above_gmt_hrs_2)
crv_elev_nodes_local_moved_unshattered_2 = Curve(crv_elev_nodes_local_moved_unshattered)
pt_pedestrian_podium_above_gmt_hrs_3 = Point(pt_pedestrian_podium_above_gmt_hrs_2)
pt_elev_ctr_all_levels_0_115_podium_3 = Point(pt_elev_ctr_all_levels_0_115_podium_2)
crv_elev_nodes_local_moved_1_3 = Curve(crv_elev_nodes_local_moved_1)
pt_elev_ctr_floor_levels_1_115_4 = Point(pt_elev_ctr_floor_levels_1_115_3)
crv_elev_nodes_local_moved_4 = Curve(crv_elev_nodes_local_moved_3)
pt_elev_ctr_all_levels_0_115_4 = Point(pt_elev_ctr_all_levels_0_115_3)
crv_unit_floorlines_2 = Curve(simplify(crv_unit_floorlines))
pt_elev_ctr_podium_levels_4 = Point(pt_elev_ctr_podium_levels_3)
crv_elev_nodes_express_4 = Curve(crv_elev_nodes_express_3)
pt_elev_ctr_local_moved_2 = Point(pt_elev_ctr_local_moved)
crv_footprint_centerline_3 = Curve(crv_footprint_centerline_2)
num_floor_height_total_6 = Number(num_floor_height_total_4)
crv_elevators_footprint_4 = Curve(crv_elevators_footprint_2)
crv_elevator_centerline_7 = Curve(crv_elevator_centerline_5)
crv_podium_footprint_5 = Curve(crv_podium_footprint_2)
crv_podium_footprint_6 = Curve(crv_podium_footprint)
srf_16_units_footprint_8 = Surface(srf_16_units_footprint_3)
crv_elev_nodes_local_4 = Curve(crv_elev_nodes_local_2)
brep_activity_centers_2 = Brep(brep_activity_centers)
pt_elev_ctr_level_115_4 = Point(pt_elev_ctr_level_115_3)
crv_bridge_bottom_2 = Curve(extend_curve_2)
pt_elev_ctr_express_3 = Point(pt_elev_ctr_express_2)
brep_module_unit_3 = Brep(brep_module_unit_2)
crv_unit_footprint_2 = Curve(crv_unit_footprint)
pt_elev_ctr_local_10 = Point(pt_elev_ctr_local_2)
pt_gmt_station_3 = Point(pt_gmt_station_2)
brep_elevators_3 = Brep(brep_elevators_2)
pt_hrs_station_2 = Point(pt_hrs_station)
brep_podium_2 = Brep(brep_podium)
crv_gmt_line_2 = Curve(crv_gmt_line)
crv_hrs_line_2 = Curve(crv_hrs_line)
crv_bridges_2 = Curve(extend_curve)

pt_elev_ctr_local_11 = Point(pt_elev_ctr_local_moved_2)
crv_elev_nodes_local_5 = Curve(crv_elev_nodes_local_moved_1_3)
crv_elev_nodes_express_5 = Curve(crv_elev_nodes_express_4)
pt_pedestrian_podium_above_gmt_hrs_4 = Point(pt_pedestrian_podium_above_gmt_hrs_3)

swatch_2 = ColourSwatch(SwatchColor=RGB(24, 107, 158))
panel_9 = Panel("Preview setup")
swatch_3 = ColourSwatch(SwatchColor=RGB(161, 199, 48))
swatch_4 = ColourSwatch(SwatchColor=RGB(255, 255, 255))
hrs = ColourSwatch(SwatchColor=RGB(255, 61, 61))
gmt = ColourSwatch(SwatchColor=RGB(255, 157, 0))
crv_unit_footprint_3 = Curve(crv_unit_footprint_2)
crv_bridges_3 = Curve(crv_bridges_2)
pt_elev_ctr_express_4 = Point(pt_elev_ctr_express_3)
crv_unit_floorlines_3 = Curve(simplify(crv_unit_floorlines_2))
crv_hrs_line_3 = Curve(crv_hrs_line_2)
pt_hrs_station_3 = Point(pt_hrs_station_2)
crv_gmt_line_3 = Curve(crv_gmt_line_2)
brep_activity_centers_3 = Brep(brep_activity_centers_2)
pt_elev_ctr_all_levels_0_115_5 = Point(pt_elev_ctr_all_levels_0_115_4)
pt_gmt_station_4 = Point(pt_gmt_station_3)
crv_bridge_bottom_3 = Curve(crv_bridge_bottom_2)
sph = Sphere(Base=pt_elev_ctr_express_4, Radius=Slider(7, range=0..100))
sph_2 = Sphere(Base=pt_pedestrian_podium_above_gmt_hrs_4, Radius=Slider(6.7, range=0..100))
sph_3 = Sphere(Base=pt_hrs_station_3, Radius=Slider(9.2, range=0..100))
sph_4 = Sphere(Base=pt_gmt_station_4, Radius=Slider(9.2, range=0..100))
wires = BrepWireframe(Brep=brep_activity_centers_3, Density=-1)

crv_pedestrian_podium_above_gmt_hrs_4 = Curve(crv_pedestrian_podium_above_gmt_hrs_3)
sph_5 = Sphere(Base=pt_elev_ctr_local_11, Radius=Slider(5, range=0..100))
pipe = Pipe(Curve=crv_elev_nodes_express_5, Radius=Slider(4, range=0..100), Caps=1)
pipe_2 = Pipe(Curve=crv_elev_nodes_local_5, Radius=Slider(2, range=0..100), Caps=1)

# ---- group: Podium
previewmat = CustomPreviewMaterials(Geometry=brep_podium_2, DiffuseColor=ColourSwatch(SwatchColor=RGB(171, 252, 255)), Transparency=Slider(0.41, range=0..1))
toggle = GroupToggle(ToggleActive=False, ToggleVisible=True)  # disabled

# ----
previewmat_2 = CustomPreviewMaterials(Geometry=sph, DiffuseColor=swatch_2, Transparency=Slider(0.23, range=0..1))
previewmat_3 = CustomPreviewMaterials(Geometry=sph_5, DiffuseColor=swatch, Transparency=Slider(0.23, range=0..1))
previewmat_4 = CustomPreviewMaterials(Geometry=pipe, DiffuseColor=swatch_2, Transparency=Slider(0.57, range=0..1))
previewmat_5 = CustomPreviewMaterials(Geometry=pipe_2, DiffuseColor=swatch, Transparency=Slider(0, range=0..1))
toggle_2 = GroupToggle(ToggleActive=False, ToggleVisible=True)  # disabled

previewmat_6 = CustomPreviewMaterials(Geometry=brep_activity_centers_3, DiffuseColor=swatch_4, Transparency=Slider(0.2, range=0..1))
previewlw = CustomPreviewLineweights(Geometry=wires, Shader=swatch_4, Thickness=Slider(3.5, range=0..100), Absolute=False)
previewlw_2 = CustomPreviewLineweights(
    Geometry=crv_unit_floorlines_3,
    Shader=ColourSwatch(SwatchColor=RGB(224, 224, 224)),
    Thickness=Slider(1, range=0..100),
    Absolute=False)
toggle_3 = GroupToggle(ToggleActive=False, ToggleVisible=True)  # disabled

previewmat_7 = CustomPreviewMaterials(Geometry=sph_4, DiffuseColor=gmt, Transparency=Slider(0.2, range=0..1))
previewmat_8 = CustomPreviewMaterials(Geometry=sph_3, DiffuseColor=hrs, Transparency=Slider(0.2, range=0..1))
previewmat_9 = CustomPreviewMaterials(Geometry=sph_2, DiffuseColor=swatch_3, Transparency=Slider(0.2, range=0..1))
previewlw_3 = CustomPreviewLineweights(Geometry=crv_gmt_line_3, Shader=gmt, Thickness=Slider(10, range=0..10), Absolute=False)
previewlw_4 = CustomPreviewLineweights(Geometry=crv_hrs_line_3, Shader=hrs, Thickness=Slider(10, range=0..10), Absolute=False)
previewlw_5 = CustomPreviewLineweights(Geometry=crv_pedestrian_podium_above_gmt_hrs_4, Shader=swatch_3, Thickness=Slider(7.2, range=0..10), Absolute=False)
toggle_4 = GroupToggle(ToggleActive=False, ToggleVisible=True)  # disabled

previewlw_6 = CustomPreviewLineweights(
    Geometry=crv_unit_footprint_3,
    Shader=ColourSwatch(SwatchColor=RGB(56, 69, 255)),
    Thickness=Slider(5.5, range=0..10),
    Absolute=False)
toggle_5 = GroupToggle(ToggleActive=False, ToggleVisible=True)  # disabled

previewlw_7 = CustomPreviewLineweights(
    Geometry=crv_bridges_3,
    Shader=ColourSwatch(SwatchColor=RGB(186, 191, 255)),
    Thickness=Slider(6.8, range=0..10),
    Absolute=False)
previewlw_8 = CustomPreviewLineweights(
    Geometry=crv_bridge_bottom_3,
    Shader=ColourSwatch(SwatchColor=RGB(85, 93, 212)),
    Thickness=Slider(10, range=0..10),
    Absolute=False)
toggle_6 = GroupToggle(ToggleActive=False, ToggleVisible=True)  # disabled

points_2 = PointList(Points=pt_elev_ctr_all_levels_0_115_5)
toggle_7 = GroupToggle(ToggleActive=False, ToggleVisible=True)  # disabled

panel_10 = Panel("Stream gh data")
pt_elev_ctr_express_5 = Point(pt_elev_ctr_express_3)
pt_elev_ctr_local_12 = Point(pt_elev_ctr_local_10)
crv_elev_nodes_express_6 = Curve(crv_elev_nodes_express_5)
crv_elev_nodes_local_6 = Curve(crv_elev_nodes_local_5)
pt_elev_ctr_express_6 = Point(pt_elev_ctr_express_4)
pt_elev_ctr_local_13 = Point(pt_elev_ctr_local_11)
crv_bridges_4 = Curve(crv_bridges_3)
crv_hrs_line_4 = Curve(crv_hrs_line_2)
crv_gmt_line_4 = Curve(crv_gmt_line_2)
pt_hrs_station_4 = Point(pt_hrs_station_2)
pt_gmt_station_5 = Point(pt_gmt_station_3)
crv_bridge_bottom_4 = Curve(crv_bridge_bottom_3)
pt_ped_above_gmt_hrs = Point(pt_pedestrian_podium_above_gmt_hrs_2)
crv_ped_above_gmt_hrs = Curve(crv_pedestrian_podium_above_gmt_hrs_2)
crv_elev_nodes_express_7 = ClusterOutput(crv_elev_nodes_express_6)
crv_elev_nodes_local_7 = ClusterOutput(crv_elev_nodes_local_6)
crv_bridge_bottom_5 = ClusterOutput(crv_bridge_bottom_4)
pt_elev_ctr_express_7 = ClusterOutput(pt_elev_ctr_express_5)
pt_elev_ctr_express_8 = ClusterOutput(pt_elev_ctr_express_6)
pt_elev_ctr_local_14 = ClusterOutput(pt_elev_ctr_local_12)
pt_elev_ctr_local_15 = ClusterOutput(pt_elev_ctr_local_13)
pt_gmt_station_6 = ClusterOutput(pt_gmt_station_5)
pt_hrs_station_5 = ClusterOutput(pt_hrs_station_4)
crv_gmt_line_5 = ClusterOutput(crv_gmt_line_4)
crv_hrs_line_5 = ClusterOutput(crv_hrs_line_4)
crv_bridges_5 = ClusterOutput(crv_bridges_4)

crv_ped_above_gmt_hrs_2 = ClusterOutput(crv_ped_above_gmt_hrs)
pt_ped_above_gmt_hrs_2 = ClusterOutput(pt_ped_above_gmt_hrs)

# ==== cluster Cluster_2
manualpts = ClusterInput()
manualpts_2 = Data(manualpts)
list_length = ListLength(List=manualpts_2)
attrname = ClusterInput()
duplicate_data = DuplicateData(AttrName=attrname, Number=list_length, Order=True)
pts = Data(manualpts_2)
attr = Data(duplicate_data)
pts_2 = ClusterOutput(pts)
attr_2 = ClusterOutput(attr)
